# Grasshopper definition LightBudget_Co-simulation platform_Single-family houses.gh (Grasshopper 1.0.7)
# Copyright: CC by Martin Dembski
# Copyright: by Martin Dembski
# plug-ins: TT Toolbox, Pufferfish, ClimateStudioGH

path = FilePath("C:\Users\nazanin.rezaei\OneDrive - HESSO\03.Nazanin's PhD\Input files\NPR LightBudget\Generalizability\Metamodeling\20231213_samples 1152.xlsx")
readxl = ReadExcelSheet(Run=Toggle(True), FilePath=path, Worksheet=Slider(1, range=0..10), Listen=False)  # -> UserMessages, Columns, flatten(Rows)
panel = Panel(readxl.Columns)
panel_2 = Panel(readxl.Rows)

# ----
# Animation steps:
# 1-Turn OFF the RECORD (write on Excel)
# 2- Set the TIMER to 0 (press Button)
# 3- Turn ON  the RECORD (write on Excel)
# 4- enable grasshoper timer and set the toggle to TRUE
# -----------------
# NOTE: set the animation frame rate
#  based on mDA simulation
#  time on this computer
# Timer
button = Button()
timer = Timer(Interval=9000, TimerInterval=9000, Target=c_script)  # disabled
c_script = CSharpScript(reset=button, run=Toggle(False))  # -> out, A; inputs reset: Boolean, run: Boolean
# ---------- c_script: C# usings ----------
using System.IO;
using System.Linq;
using System.Data;
using System.Drawing;
using System.Reflection;
using System.Windows.Forms;
using System.Xml;
using System.Xml.Linq;
using System.Runtime.InteropServices;

using Rhino.DocObjects;
using Rhino.Collections;
using GH_IO;
using GH_IO.Serialization;
# ---------- c_script: C# ----------
    Component.Message = "Timer";

    if (reset)
      n = 0;
    else if (run){
      n++;
    }

    A = n;
# ---------- c_script: C# additional code ----------
  int n = 0;
# ---------- end c_script ----------
panel_3 = Panel(c_script.A)
number_of_totall_samples = Panel("3585")
smaller = SmallerThan(FirstNumber=panel_3, SecondNumber=number_of_totall_samples)  # -> SmallerThan, OrEqualTo
panel_4 = Panel(smaller.OrEqualTo)
dispatch = Dispatch(List=c_script.A, DispatchPattern=panel_4)  # -> ListA, ListB

# ----
# 1. “ms” is for million seconds. 1000ms equals 1 second interval.
# 2. Require to set a maximum count to start counting.
# 3. Counting stops at maximum.
toggle = BooleanToggle(True)
dcounter = Zh_UtilityDocumentCounter(reset=Button(), ms=Slider(2000, range=0..100000), max=Slider(1153, range=0..6000), pause=toggle)  # -> out, A; inputs reset: Boolean, ms: Int32, max: Int32, pause: Boolean
# ---------- dcounter: C# ----------
if(pause == false)
{
if(c < max)
{
    if(ms == 0)//0ms = 1ms
    {
        c++;
        GrasshopperDocument.ScheduleSolution
            (1, doc => {Component.ExpireSolution(false);});
    }

    else if(ms > 0)
    {
        c++;
        GrasshopperDocument.ScheduleSolution
            (ms, doc => {Component.ExpireSolution(false);});
    }

}
}
if(reset) c = 0;

A = c;
# ---------- dcounter: C# additional code ----------
  int c = 0;
# ---------- end dcounter ----------
number_of_totall_samples_2 = Panel("1153")
id = Panel(dcounter.A)
smaller_2 = SmallerThan(FirstNumber=id, SecondNumber=number_of_totall_samples_2)  # -> SmallerThan, OrEqualTo
panel_5 = Panel(smaller_2.OrEqualTo)
dispatch_2 = Dispatch(List=dcounter.A, DispatchPattern=panel_5)  # -> ListA, ListB
item = ListItem(List=panel, Index=Slider(17, range=0..1000), Wrap=True)
panel_6 = Panel(item)
interior_wall_to_floor_area_ratio = Panel("0.4")
item_2 = ListItem(List=flatten(panel_6), Index=Slider(1, range=0..20), Wrap=True)
item_3 = ListItem(List=flatten(panel_6), Index=Slider(2, range=0..20), Wrap=True)
item_4 = ListItem(List=flatten(panel_6), Index=Slider(4, range=0..10), Wrap=True)
item_5 = ListItem(List=flatten(panel_6), Index=Slider(5, range=0..10), Wrap=True)
item_6 = ListItem(List=flatten(panel_6), Index=Slider(0, range=0..20), Wrap=True)
item_7 = ListItem(List=flatten(panel_6), Index=Slider(3, range=0..10), Wrap=True)
item_8 = ListItem(List=flatten(panel_6), Index=Slider(6, range=0..10), Wrap=True)
item_9 = ListItem(List=flatten(panel_6), Index=Slider(7, range=0..20), Wrap=True)
item_10 = ListItem(List=flatten(panel_6), Index=Slider(9, range=0..10), Wrap=True)
item_11 = ListItem(List=flatten(panel_6), Index=Slider(13, range=0..20), Wrap=True)
item_12 = ListItem(List=flatten(panel_6), Index=Slider(14, range=0..20), Wrap=True)
item_13 = ListItem(List=flatten(panel_6), Index=Slider(11, range=0..20), Wrap=True)
item_14 = ListItem(List=flatten(panel_6), Index=Slider(10, range=0..10), Wrap=True)
item_15 = ListItem(List=flatten(panel_6), Index=Slider(15, range=0..20), Wrap=True)
item_16 = ListItem(List=flatten(panel_6), Index=Slider(16, range=0..20), Wrap=True)
wwr = Panel(item_6)
wdr = Panel(item_2)
balcony_depth_m = Panel(item_3)
glazing = Panel(item_7)
frame = Panel(item_4)
shading = Panel(item_5)
pv = Panel(item_8)
building_u = Panel("1")
facade_cladding = Panel(item_10)
wall_structure = Panel(item_14)
climate = Panel(item_11)
underground = Panel(item_12)
wall_insulation = Panel(item_13)
facade_orientation = Panel(item_15)
context = Panel(item_16)
floor_wdr = Panel("""0
0.8
1
1.2
1.4""")
wwr_values = Panel("""0
0.20
0.30
0.40
0.50""")
building_u_2 = Panel("""0
0.10
0.125
0.15
0.2""")
shading_type = Panel("""0
Open
45_open
45_open
45_open""")
smaller_3 = SmallerThan(FirstNumber=shading, SecondNumber=Slider(1, range=0..1))  # -> SmallerThan, OrEqualTo
larger = LargerThan(FirstNumber=shading, SecondNumber=Slider(2, range=0..10))  # -> LargerThan, OrEqualTo
item_17 = ListItem(List=wwr_values, Index=wwr, Wrap=True)
item_18 = ListItem(List=floor_wdr, Index=wdr, Wrap=True)
item_19 = ListItem(List=building_u_2, Index=building_u, Wrap=True)
gate = StreamGate(Stream=Slider(2, range=0..10), Gate=smaller_3.OrEqualTo)  # -> Target0, Target1
gate_2 = StreamGate(Stream=Slider(0, range=0..100), Gate=larger.OrEqualTo)  # -> Target0, Target1

# ----
# Wall insulation calculations
thermal_bridges = Panel("0.07")
exterior_cladding_r_value = Panel("""0
0.18
0.20
0.29
0.29""")
wall_structure_r_value = Panel("""0
0.30
0.55
1.08
1.45""")
insulation_lambda = Panel("""0
0.06
0.06
0.031
0.032""")
item_20 = ListItem(List=exterior_cladding_r_value, Index=facade_cladding, Wrap=True)
item_21 = ListItem(List=wall_structure_r_value, Index=wall_structure, Wrap=True)
item_22 = ListItem(List=insulation_lambda, Index=wall_insulation, Wrap=True)
addition = Addition(A=item_20, B=item_21, C=Slider(0.125, range=0..1), D=Slider(0.04, range=0..0.1))
subtraction = Subtraction(A="1", B=thermal_bridges)
panel_7 = Panel(addition)
multiplication = Multiplication(A=subtraction, B=item_19)
u_value_integrating_thermal_bridges = Panel(multiplication)
division = Division(A="1", B=u_value_integrating_thermal_bridges)
insulation_density_kg_m3 = Panel("""0
215
35
30
30""")
insulation_biogenic_gwp_kg_co2_eq_y = Panel("""0
0.05
0.05
0.00
0.00""")
insulation_gwp_kg_co2_eq_y = Panel("""0
0.003
0.009
0.037
0.253""")
targeted_r_value = Panel(division)
subtraction_2 = Subtraction(A=targeted_r_value, B=panel_7)
required_insulation_r_value_for_walls = Panel(subtraction_2)
multiplication_2 = Multiplication(A=required_insulation_r_value_for_walls, B=item_22)
required_insulation_thickness_m = Panel(multiplication_2)
item_23 = ListItem(List=insulation_gwp_kg_co2_eq_y, Index=wall_insulation, Wrap=True)
item_24 = ListItem(List=insulation_density_kg_m3, Index=wall_insulation, Wrap=True)
item_25 = ListItem(List=insulation_biogenic_gwp_kg_co2_eq_y, Index=wall_insulation, Wrap=True)
multiplication_3 = Multiplication(A=required_insulation_thickness_m, B=item_24, C=item_25)
multiplication_4 = Multiplication(A=required_insulation_thickness_m, B=item_24, C=item_23)

gf_slab_structure_r_value = Panel("""0
0.36
2.13
1.30
0.36""")
# GF Slab insulation calculations
thermal_bridges_2 = Panel("0.07")
item_26 = ListItem(List=gf_slab_structure_r_value, Index=0, Wrap=True)
addition_2 = Addition(A=item_26, B=Slider(0.125, range=0..1), C=Slider(0.04, range=0..0.1))
subtraction_3 = Subtraction(A="1", B=thermal_bridges_2)
panel_8 = Panel(addition_2)
multiplication_5 = Multiplication(A=subtraction_3, B=item_19)
u_value_integrating_thermal_bridges_2 = Panel(multiplication_5)
division_2 = Division(A="1", B=u_value_integrating_thermal_bridges_2)
targeted_r_value_2 = Panel(division_2)
subtraction_4 = Subtraction(A=targeted_r_value_2, B=panel_8)
required_insulation_r_value_for_slabs = Panel(subtraction_4)
multiplication_6 = Multiplication(A=required_insulation_r_value_for_slabs, B=item_22)
required_gf_slab_insulation_thickness_m = Panel(multiplication_6)
multiplication_7 = Multiplication(A=required_gf_slab_insulation_thickness_m, B=item_24, C=item_25)

material = GetCSLightingMaterial(UnitSystem=4)
material_2 = GetCSLightingMaterial(UnitSystem=4)
item_27 = ListItem(List=shading_type, Index=shading, Wrap=True)
shade = GetCSWovenShade(Search=item_27, UnitSystem=4)
panel_9 = Panel(shade)
item_28 = ListItem(List=shade, Index=[gate.Target1, gate_2.Target1], Wrap=True)
facen = FaceNormals()  # -> Centers, Normals
vdis = VectorDisplay(Anchor=facen.Centers, Vector=facen.Normals)
building_u_3 = Slider(0.15, range=0..1)
panel_10 = Panel("""0
C:\Users\nazanin.rezaei\Downloads\Climate epw file\CHE_ZH_Zurich.AP.066700_TMYx.2007-2021.epw
C:\Users\nazanin.rezaei\Downloads\Climate epw file\CHE_FR_Fribourg.Posieux.066250_TMYx.2007-2021.epw
C:\Users\nazanin.rezaei\Downloads\Climate epw file\CHE_VS_Zermatt.067480_TMYx.2007-2021.epw
C:\Users\nazanin.rezaei\Downloads\Climate epw file\CHE_TI_Locarno.Monti.067600_TMYx.2007-2021.epw""")
item_29 = ListItem(List=panel_10, Index=climate, Wrap=True)

# ---- group: Climate epw
path_2 = FilePath(item_29)

# ----
multiplication_8 = Multiplication(A=required_gf_slab_insulation_thickness_m, B=item_24, C=item_23)
zurich = FilePath("C:\Users\nazanin.rezaei\Downloads\Climate epw file\CHE_ZH_Zurich.AP.066700_TMYx.2007-2021.epw")
locarno = FilePath("C:\Users\nazanin.rezaei\Downloads\Climate epw file\CHE_TI_Locarno.Monti.067600_TMYx.2007-2021.epw")
number_slider = Slider(103, range=0..1000)
number_slider_2 = Slider(-15, range=-100..100)
sqrt = SquareRoot(Value=number_slider)
number_slider_3 = Slider(15, range=0..100)
number_slider_4 = Slider(0, range=0..100)
number_slider_5 = Slider(0, range=0..100)
number_slider_6 = Slider(26, range=0..100)
number_slider_7 = Slider(-26, range=-100..100)
panel_11 = Panel(sqrt)
pt = ConstructPoint(XCoordinate=number_slider_4, YCoordinate=number_slider_6, ZCoordinate=number_slider_5)
pt_2 = ConstructPoint(XCoordinate=number_slider_3, YCoordinate=number_slider_6, ZCoordinate=number_slider_5)
pt_3 = ConstructPoint(XCoordinate=number_slider_2, YCoordinate=number_slider_6, ZCoordinate=number_slider_5)
pt_4 = ConstructPoint(XCoordinate=number_slider_4, YCoordinate=number_slider_7, ZCoordinate=number_slider_5)
pt_5 = ConstructPoint(XCoordinate=number_slider_3, YCoordinate=number_slider_7, ZCoordinate=number_slider_5)
pt_6 = ConstructPoint(XCoordinate=number_slider_2, YCoordinate=number_slider_7, ZCoordinate=number_slider_5)
pt_7 = ConstructPoint(XCoordinate=number_slider_2, YCoordinate=number_slider_5, ZCoordinate=number_slider_5)
pt_8 = ConstructPoint(XCoordinate=number_slider_3, YCoordinate=number_slider_5, ZCoordinate=number_slider_5)
pt_9 = ConstructPoint(XCoordinate=0, YCoordinate=0, ZCoordinate=0)
pt_10 = ConstructPoint(XCoordinate=panel_11, YCoordinate=panel_11, ZCoordinate=0)
number_slider_8 = Slider(1, range=0..1)
rec_2pt = Rectangle2Pt(Plane=PlaneXY(0, 0, 0), PointA=pt_9, PointB=pt_10, Radius=0)  # -> Rectangle, Length
brep = Brep(rec_2pt.Rectangle)
division_3 = Division(A=number_slider_8, B=item_18)
area = Area(Geometry=rec_2pt.Rectangle)  # -> Area, Centroid
scale2area = ScaleToArea(Geometry=brep, Plane=area.Centroid, Area=number_slider, FactorX=number_slider_8, FactorY=division_3, FactorZ=1)  # -> Scaled, Transform
debrep = DeconstructBrep(Brep=scale2area.Scaled)  # -> Faces, Edges, Vertices
debrep_2 = DeconstructBrep(Brep=scale2area.Scaled)  # -> Faces, Edges, Vertices
debrep_3 = DeconstructBrep(Brep=scale2area.Scaled)  # -> Faces, Edges, Vertices
debrep_4 = DeconstructBrep(Brep=scale2area.Scaled)  # -> Faces, Edges, Vertices
item_30 = ListItem(List=debrep.Edges, Index=Slider(2, range=0..10), Wrap=True)
item_31 = ListItem(List=debrep_2.Edges, Index=Slider(1, range=0..1), Wrap=True)
item_32 = ListItem(List=debrep_4.Edges, Index=Slider(3, range=0..10), Wrap=True)
item_33 = ListItem(List=debrep_3.Edges, Index=Slider(0, range=0..100), Wrap=True)

number_slider_9 = Slider(2.4, range=0..10)
pt_11 = Point(Point(0, 0, 0))
Z = UnitZ(Factor=number_slider_9)
# East untrimmed wall
extr = Extrude(Base=item_31, Direction=Z)
# South untrimmed wall
extr_2 = Extrude(Base=item_33, Direction=Z)
# West untrimmed wall
extr_3 = Extrude(Base=item_32, Direction=Z)
# North untrimmed wall
extr_4 = Extrude(Base=item_30, Direction=Z)

move = Move(Geometry=scale2area.Scaled, Motion=Z)  # -> Geometry, Transform

# ----
# Roof
multiplication_9 = Multiplication(A=number_slider_9, B=Slider(2, range=0..10))
Z_2 = UnitZ(Factor=multiplication_9)
move_2 = Move(Geometry=scale2area.Scaled, Motion=Z_2)  # -> Geometry, Transform

area_2 = Area(Geometry=move_2.Geometry)  # -> flatten(Area), Centroid
panel_12 = Panel(area_2.Area)
ma = MassAddition(Input=panel_12)  # -> Result, PartialResults
roof_area_m2 = Panel(ma.Result)
preview = CustomPreview(Geometry=move_2.Geometry, Material=ColourSwatch(SwatchColor=RGB(135, 135, 135)))
move_3 = Move(Geometry=scale2area.Scaled, Motion=pt)  # -> Geometry, Transform
move_4 = Move(Geometry=scale2area.Scaled, Motion=pt_2)  # -> Geometry, Transform
move_5 = Move(Geometry=scale2area.Scaled, Motion=pt_3)  # -> Geometry, Transform
move_6 = Move(Geometry=scale2area.Scaled, Motion=pt_4)  # -> Geometry, Transform
move_7 = Move(Geometry=scale2area.Scaled, Motion=pt_5)  # -> Geometry, Transform
move_8 = Move(Geometry=scale2area.Scaled, Motion=pt_6)  # -> Geometry, Transform
move_9 = Move(Geometry=scale2area.Scaled, Motion=pt_8)  # -> Geometry, Transform
move_10 = Move(Geometry=scale2area.Scaled, Motion=pt_7)  # -> Geometry, Transform
midpt = CurveMiddle(Curve=item_32)
midpt_2 = CurveMiddle(Curve=item_31)
multiplication_10 = Multiplication(A=number_slider_9, B=Slider(2, range=0..10))
ln = Line(StartPoint=midpt, EndPoint=midpt_2)
number_slider_10 = Slider(4, range=0..10)
debrep_5 = DeconstructBrep(Brep=extr_2)  # -> Faces, Edges, Vertices
Z_3 = UnitZ(Factor=multiplication_10)
extr_5 = Extrude(
    Base=[move_3.Geometry, move_4.Geometry, move_5.Geometry, move_6.Geometry, move_7.Geometry, move_8.Geometry, move_9.Geometry, move_10.Geometry],
    Direction=Z_3)
debrep_6 = DeconstructBrep(Brep=extr_2)  # -> Faces, Edges, Vertices
item_34 = ListItem(List=debrep_5.Edges, Index=Slider(3, range=0..100), Wrap=True)
extr_6 = Extrude(Base=ln, Direction=Z)
item_35 = ListItem(List=debrep_5.Edges, Index=Slider(1, range=0..10), Wrap=True)
divide = DivideCurve(Curve=item_34, Count=number_slider_10, Kinks=False)  # -> Points, Tangents, Parameters
item_36 = ListItem(List=debrep_6.Vertices, Index=0, Wrap=True)
smaller_4 = SmallerThan(FirstNumber=context, SecondNumber=Slider(1, range=0..1))  # -> SmallerThan, OrEqualTo
divide_2 = DivideCurve(Curve=item_35, Count=number_slider_10, Kinks=False)  # -> Points, Tangents, Parameters

window_height_m = Panel("""0
2.00
2.20
2.40
2.60""")
item_37 = ListItem(List=window_height_m, Index=Slider(1, range=1..4), Wrap=True)

item_38 = ListItem(List=divide.Points, Index=Slider(3, range=0..10), Wrap=True)
item_39 = ListItem(List=divide.Points, Index=Slider(1, range=0..10), Wrap=True)
number_slider_11 = Slider(1, range=0..1)
item_40 = ListItem(List=divide.Points, Index=Slider(2, range=0..10), Wrap=True)
# CONNECT: Balcony depth index
movetoplane = MoveToPlane(Geometry=item_40, Plane=extr_4, Above=True, Below=True)  # -> Geometry, Transform
ln_2 = Line(StartPoint=movetoplane.Geometry, EndPoint=item_40)
extr_7 = Extrude(Base=ln_2, Direction=Z)
number_slider_12 = Slider(1, range=0..1)
image = ImageSampler(Filter="Colour", Interpolate=False, Umax=1, Umin=0, Vmax=1, Vmin=0, Wrap=0)
image_2 = ImageSampler(Filter="Colour", Interpolate=False, Umax=1, Umin=0, Vmax=1, Vmin=0, Wrap=1)
# Special component for windows which you need
# to use instead of default components. The only
# difference - window component contains g-value
# and window to frame ratio additionally. G-value -
# solar heat gain coefficient, used only for
# transparent objects, does not have a unit.
image_3 = ImageSampler(Filter="Colour", Interpolate=False, Umax=1, Umin=0, Vmax=1, Vmin=0, Wrap=1)
winodw_u_value = Panel("""0
1.1
0.9
0.7
0.5""")
g_value = Panel("""0
0.60
0.55
0.50
0.45""")
len = Length(Curve=scale2area.Scaled)
gate_3 = StreamGate(Stream=extr_5, Gate=smaller_4.OrEqualTo)  # -> Target0, Target1
item_41 = ListItem(List=divide_2.Points, Index=Slider(1, range=0..1), Wrap=True)
multiplication_11 = Multiplication(A=frame, B=number_slider_12)
multiplication_12 = Multiplication(A=glazing, B=number_slider_12)
pdecon = Deconstruct(Point=item_38)  # -> XComponent, YComponent, ZComponent
pdecon_2 = Deconstruct(Point=item_39)  # -> XComponent, YComponent, ZComponent
ma_2 = MassAddition(Input=len)  # -> Result, PartialResults
brep_2 = Brep(gate_3.Target0)
brep_3 = Brep(gate_3.Target1)
scenelayer = ConstructCSSceneLayer(
    Name="Context",
    Material=material_2,
    Geometry=flatten([brep_2, brep_3]),
    Input_0_Hidden=False,
    Input_0_Name="Name",
    Input_1_Hidden=False,
    Input_1_Name="Material",
    Input_2_Hidden=False,
    Input_2_Name="Geometry",
    Input_3_Hidden=True,
    Input_3_Name="ViewTag",
    UnitSystem=4,
    Input_3_GHParam_Branch0_Path="{0}",
    Input_3_GHParam_Branch0_Item0_null_string=False,
    Input_3_GHParam_Branch0_Item0_string="None")
python = GhPythonScript(x=multiplication_12, y=multiplication_11)  # -> out, a
# ---------- python: Python ----------
__author__ = "nazanin.rezaei"
__version__ = "2022.10.06"

import rhinoscriptsyntax as rs
if x==1 and y==1:
    a=1.5
if x==1 and y==2:
    a=1.5
if x==1 and y==3:
    a=1.8
if x==1 and y==4:
    a=1.8
if x==2 and y==1:
    a=1.4
if x==2 and y==2:
    a=1.4
if x==2 and y==3:
    a=1.7
if x==2 and y==4:
    a=1.7
if x==3 and y==1:
    a=1.2
if x==3 and y==2:
    a=1.2
if x==3 and y==3:
    a=1.4
if x==3 and y==4:
    a=1.4
if x==4 and y==1:
    a=1
if x==4 and y==2:
    a=1
if x==4 and y==3:
    a=1.2
if x==4 and y==4:
    a=1.2
# ---------- end python ----------
item_42 = ListItem(List=g_value, Index=glazing, Wrap=True)
multiplication_13 = Multiplication(A=item_42, B=number_slider_11)
item_43 = ListItem(List=winodw_u_value, Index=glazing, Wrap=True)
multiplication_14 = Multiplication(A=item_43, B=number_slider_11)
building_perimeter_m = Panel(ma_2.Result)
window_u_value = Panel(python.a)

area_3 = Area(Geometry=extr_2)  # -> Area, Centroid
ma_3 = MassAddition(Input=area_3.Area)  # -> Result, PartialResults
multiplication_15 = Multiplication(A=ma_3.Result, B=item_17)
division_4 = Division(A=multiplication_15, B=item_37)
total_n_s_window_width_m = Panel(division_4)
panel_13 = Panel(ma_3.Result)

# ----
# W1
# W2
# W3
# W4
no_of_windows = Slider(4, range=0..10)
division_5 = Division(A=total_n_s_window_width_m, B=no_of_windows)
rectangle = Rectangle(Plane=PlaneXY(0, 0, 0), XSize=division_5, YSize=item_37, Radius=0)  # -> graft(Rectangle), Length
yz = YZPlane(Origin=Point(0, 0, 0))
rotate = Rotate(Geometry=rectangle.Rectangle, Angle=1.570796327, Plane=yz)  # -> Geometry, Transform
debrep_7 = DeconstructBrep(Brep=rotate.Geometry)  # -> Faces, Edges, Vertices
item_44 = ListItem(List=debrep_7.Edges, Index=0, Wrap=True)
crvmidpt = CurveMiddlePoint(Curve=item_44, EvaluationType=False)  # -> Middle, Tangent, Parameter, Length
divide_3 = DivideCurve(Curve=item_33, Count=Slider(8, range=0..10), Kinks=False)  # -> Points, Tangents, Parameters
item_45 = ListItem(List=divide_3.Points, Index=Slider(5, range=-1..10), Wrap=True)
item_46 = ListItem(List=divide_3.Points, Index=Slider(3, range=-1..10), Wrap=True)
item_47 = ListItem(List=divide_3.Points, Index=Slider(1, range=-1..10), Wrap=True)
item_48 = ListItem(List=divide_3.Points, Index=Slider(7, range=-1..10), Wrap=True)
move2pt = MoveToPoint(Geometry=debrep_7.Faces, PointA=crvmidpt.Middle, PointB=item_48)  # -> Moved, Vector, Transform
move2pt_2 = MoveToPoint(Geometry=debrep_7.Faces, PointA=crvmidpt.Middle, PointB=item_45)  # -> Moved, Vector, Transform
move2pt_3 = MoveToPoint(Geometry=debrep_7.Faces, PointA=crvmidpt.Middle, PointB=item_46)  # -> Moved, Vector, Transform
move2pt_4 = MoveToPoint(Geometry=debrep_7.Faces, PointA=crvmidpt.Middle, PointB=item_47)  # -> Moved, Vector, Transform

area_4 = Area(Geometry=move2pt.Moved)  # -> Area, Centroid
python_2 = GhPythonScript(x=area_4.Area)  # -> out, a
# ---------- python_2: Python ----------
__author__ = "nazanin.rezaei"
__version__ = "2022.05.17"

import rhinoscriptsyntax as rs
if x>=2.7:
    a=2.7
if x<2.7:
    a=x
# ---------- end python_2 ----------
panel_14 = Panel(python_2.a)

# ----
# Frame to window ratio calculations
cluster = Cluster(x=python_2.a)
python_3 = GhPythonScript(x=frame, y=cluster)  # -> out, a
# ---------- python_3: Python ----------
__author__ = "nazanin.rezaei"
__version__ = "2022.05.17"

import rhinoscriptsyntax as rs
if x!=3:
    a=0
else:
    a=y+0.4679
# ---------- end python_3 ----------
cluster_2 = Cluster_2(x=python_2.a)
python_4 = GhPythonScript(x=frame, y=cluster_2)  # -> out, a
# ---------- python_4: Python ----------
__author__ = "nazanin.rezaei"
__version__ = "2022.05.17"

import rhinoscriptsyntax as rs
if x!=3:
    a=y+0.7032
else:
    a=0
# ---------- end python_4 ----------
panel_15 = Panel(cluster)
panel_16 = Panel(python_3.a)
number_slider_13 = Slider(0.4679, range=0..1)
number_slider_14 = Slider(0.7032, range=0..1)
panel_17 = Panel(cluster_2)
panel_18 = Panel(python_4.a)
addition_3 = Addition(A=python_3.a, B=python_4.a)
frame_to_window_ratio = Panel(addition_3)

brep_4 = Brep([move2pt_4.Moved, move2pt_3.Moved, move2pt_2.Moved, move2pt.Moved])
# Components gets the windows orientations to take into account the solar gains.
# Attention: The area of the windows for the
# heating demand calculations should be taken
# from here to be able to distinguish the surfaces
# between different orientations
check_win_orien = CheckWinOrien(srf=flatten(brep_4))  # -> P, N, num_2, i

show_normals_for_check_up = BooleanToggle(True)
normal_vectors = NormalVectors(S=check_win_orien.P, G=show_normals_for_check_up, V=check_win_orien.N, G_2=show_normals_for_check_up)  # -> _0, _1, _0_2, _1_2
vdis_2 = VectorDisplay(Anchor=normal_vectors._1, Vector=normal_vectors._1_2)
# South windows
vdis_3 = VectorDisplay(Anchor=normal_vectors._0, Vector=normal_vectors._0_2)

subtraction_5 = Subtraction(A=Slider(1, range=0..1), B=frame_to_window_ratio)
larger_2 = LargerThan(FirstNumber=facade_orientation, SecondNumber=Slider(2, range=0..10))  # -> LargerThan, OrEqualTo
Y = UnitY(Factor=Slider(50, range=0..100))
extr_8 = Extrude(Base=[move2pt_4.Moved, move2pt_3.Moved, move2pt_2.Moved, move2pt.Moved], Direction=Y)
capex = CapHolesEx(Brep=extr_8)  # -> Brep, Caps, Solid
panel_19 = Panel("""0
40
36
38
16""")
item_49 = ListItem(List=panel_19, Index=climate, Wrap=True)
# This component gets the heating demand in
# kWh/m2, and multiplies it with the value for the
# selected energy carrier in kgCO2eq./kWh
# UA value is simply a U-value multiplied by
# the area. This parameter is needed for the
# heating operational consumption calculation
# Calculated the heating demand according to
# SIA 380/1 - 2016. Can be found on moodle
number_slider_15 = Slider(2, range=0..10)
number_slider_16 = Slider(1, range=0..1)
area_5 = Area(Geometry=extr_3)  # -> Area, Centroid
multiplication_16 = Multiplication(A=area_5.Area, B=item_17)
division_6 = Division(A=multiplication_16, B=item_37)
no_of_windows_2 = Slider(2, range=0..10)
total_e_w_window_width_m = Panel(division_6)
emission_losses = Panel("0.9")
production_losses = Panel("3")
distribution_losses = Panel("0.9")
number_slider_17 = Slider(12, range=0..100)
division_7 = Division(A=total_e_w_window_width_m, B=no_of_windows_2)
rectangle_2 = Rectangle(Plane=PlaneXY(0, 0, 0), XSize=division_7, YSize=item_37, Radius=0)  # -> graft(Rectangle), Length
multiplication_17 = Multiplication(A=distribution_losses, B=emission_losses, C=production_losses)
rad = Radians(Degrees=Slider(90, range=0..360))
rotate_2 = Rotate(Geometry=rectangle_2.Rectangle, Angle=rad, Plane=PlaneXY(0, 0, 0))  # -> Geometry, Transform
pt_12 = Point(Point(0, 0, 0))
pt_13 = Point(Point(0, 1, 0))
ln_3 = Line(StartPoint=pt_12, EndPoint=pt_13)
rotax = RotateAxis(Geometry=rotate_2.Geometry, Angle=1.570796327, Axis=ln_3)  # -> Geometry, Transform
conversion_factors_kg_co2_eq_kwh = Panel("0.102")
divide_4 = DivideCurve(Curve=item_32, Count=Slider(3, range=0..10), Kinks=False)  # -> Points, Tangents, Parameters
item_50 = ListItem(List=divide_4.Points, Index=[Slider(3, range=0..5), Slider(1, range=0..5)], Wrap=True)
move_11 = Move(Geometry=rotax.Geometry, Motion=item_50)  # -> Geometry, Transform
# West window
brep_5 = Brep(move_11.Geometry)
# East window
movetoplane_2 = MoveToPlane(Geometry=brep_5, Plane=extr, Above=True, Below=True)  # -> Geometry, Transform
area_6 = Area(Geometry=movetoplane_2.Geometry)  # -> Area, Centroid
area_7 = Area(Geometry=brep_5)  # -> Area, Centroid
X = UnitX(Factor=1)
extr_9 = Extrude(Base=move_11.Geometry, Direction=X)
capex_2 = CapHolesEx(Brep=extr_9)  # -> Brep, Caps, Solid
extr_10 = Extrude(Base=movetoplane_2.Geometry, Direction=X)
capex_3 = CapHolesEx(Brep=extr_10)  # -> Brep, Caps, Solid
number_slider_18 = Slider(4, range=0..4)
# East trimmed wall
trim = TrimSolid(Shape=extr, Cutters=capex_3.Brep)
# West trimmed wall
trim_2 = TrimSolid(Shape=extr_3, Cutters=capex_2.Brep)
larger_3 = LargerThan(FirstNumber=facade_orientation, SecondNumber=Slider(2, range=0..10))  # -> LargerThan, OrEqualTo
len_2 = Length(Curve=item_31)
larger_4 = LargerThan(FirstNumber=facade_orientation, SecondNumber=Slider(3, range=0..10))  # -> LargerThan, OrEqualTo
larger_5 = LargerThan(FirstNumber=facade_orientation, SecondNumber=Slider(4, range=0..10))  # -> LargerThan, OrEqualTo
len_3 = Length(Curve=item_30)
len_4 = Length(Curve=item_32)
gate_4 = StreamGate(Stream=trim_2, Gate=larger_4.OrEqualTo)  # -> Target0, Target1
python_5 = GhPythonScript(x=gate_4.Target0, y=len_4, z=number_slider_9)  # -> out, a, b
# ---------- python_5: Python ----------
__author__ = "nazanin.rezaei"
__version__ = "2022.05.21"

import rhinoscriptsyntax as rs
if x is not None:
    a=y
    b=z
else:
    a=0
    b=0
# ---------- end python_5 ----------
rectangle_3 = Rectangle(Plane=extr_3, XSize=python_5.a, YSize=python_5.b, Radius=0)  # -> Rectangle, Length
gate_5 = StreamGate(Stream=trim, Gate=larger_5.OrEqualTo)  # -> Target0, Target1
python_6 = GhPythonScript(x=gate_5.Target0, y=len_2, z=number_slider_9)  # -> out, a, b; same code as python_5
rectangle_4 = Rectangle(Plane=extr, XSize=python_6.a, YSize=python_6.b, Radius=0)  # -> Rectangle, Length
gate_6 = StreamGate(Stream=brep_5, Gate=larger_4.OrEqualTo)  # -> Target0, Target1
gate_7 = StreamGate(Stream=movetoplane_2.Geometry, Gate=larger_5.OrEqualTo)  # -> Target0, Target1
# Western walls
brep_6 = Brep(gate_4.Target1)
# Western windows
brep_7 = Brep(gate_6.Target1)
brep_8 = Brep(brep_7)
area_8 = Area(Geometry=flatten(brep_8))  # -> flatten(Area), Centroid
ma_4 = MassAddition(Input=area_8.Area)  # -> Result, PartialResults
check_win_orien_2 = CheckWinOrien(srf=flatten(brep_8))  # -> P, N, num_2, i

show_normals_for_check_up_2 = BooleanToggle(True)
normal_vectors_2 = NormalVectors(S=check_win_orien_2.P, G=show_normals_for_check_up_2, V=check_win_orien_2.N, G_2=show_normals_for_check_up_2)  # -> _0, _1, _0_2, _1_2
vdis_4 = VectorDisplay(Anchor=normal_vectors_2._1, Vector=normal_vectors_2._1_2)
# West windows
vdis_5 = VectorDisplay(Anchor=normal_vectors_2._0, Vector=normal_vectors_2._0_2)

check_win_orien_3 = CheckWinOrien(srf=flatten(brep_8))  # -> P, N, num_2, i

show_normals_for_check_up_3 = BooleanToggle(True)
normal_vectors_3 = NormalVectors(S=check_win_orien_3.P, G=show_normals_for_check_up_3, V=check_win_orien_3.N, G_2=show_normals_for_check_up_3)  # -> _0, _1, _0_2, _1_2
vdis_6 = VectorDisplay(Anchor=normal_vectors_3._1, Vector=normal_vectors_3._1_2)
# West windows
vdis_7 = VectorDisplay(Anchor=normal_vectors_3._0, Vector=normal_vectors_3._0_2)

brep_9 = Brep(rectangle_3.Rectangle)
# Eastern walls
brep_10 = Brep(gate_5.Target1)
# Eastern windows
brep_11 = Brep(gate_7.Target1)
brep_12 = Brep(brep_11)
area_9 = Area(Geometry=flatten(brep_12))  # -> flatten(Area), Centroid
ma_5 = MassAddition(Input=area_9.Area)  # -> Result, PartialResults
brep_13 = Brep(rectangle_4.Rectangle)
flip = Flip(Surface=brep_7)  # -> Surface, Result
area_10 = Area(Geometry=brep_11)  # -> Area, Centroid
area_11 = Area(Geometry=flip.Surface)  # -> Area, Centroid
larger_6 = LargerThan(FirstNumber=balcony_depth_m, SecondNumber=Slider(3, range=0..10))  # -> LargerThan, OrEqualTo
area_12 = Area(Geometry=flatten(brep_11))  # -> Area, Centroid
area_13 = Area(Geometry=flatten([brep_10, brep_13]))  # -> Area, Centroid
area_14 = Area(Geometry=flatten(brep_7))  # -> Area, Centroid
area_15 = Area(Geometry=flatten([brep_6, brep_9]))  # -> Area, Centroid
ma_6 = MassAddition(Input=area_12.Area)  # -> Result, PartialResults
ma_7 = MassAddition(Input=area_14.Area)  # -> Result, PartialResults
ma_8 = MassAddition(Input=area_15.Area)  # -> Result, PartialResults
ma_9 = MassAddition(Input=area_13.Area)  # -> Result, PartialResults
number_slider_19 = Slider(2, range=0..10)
multiplication_18 = Multiplication(A=ma_9.Result, B=number_slider_19)
multiplication_19 = Multiplication(A=ma_7.Result, B=number_slider_19)
multiplication_20 = Multiplication(A=ma_6.Result, B=number_slider_19)
multiplication_21 = Multiplication(A=ma_8.Result, B=number_slider_19)

path_3 = FilePath("C:\Users\nazanin.rezaei\OneDrive - HESSO\03.Nazanin's PhD\Input files\NPR LightBudget\Generalizability\Samples\20231213_ Outputs 1152.xlsx")
panel_20 = Panel("""Heating demand (kWh/m2)
Heating consumption (kWh/m2)
Heating consumption GWP (kg CO2-eq/m2)
Transmission losses (kWh/m2)
Ventilation losses (kWh/m2)
Occupancy gains (kWh/m2)
Electricity gains (kWh/m2)
Solar gains (kWh/m2)
Utilized gains (kWh/m2)
Ventilation consumption (kWh/m2)
Ventilation consumption GWP (kg CO2-eq/m2) 
Exterior wall area (m2)
Rough opening area (m2)
Shading (m2)
Glazing area (m2)
Frame area (m2)
Interior walls area (m2)
ERA (m2)
Roof area (m2)
Balcony slabs area (m2)
Wall insulation thickness (m)
GF Slabs/Roof insulation thickness (m)
Building Perimeter (m)
sDA (% time)
ASE (% area)
Mean illuminance (lux)
Blinds up (% time)
South wall area (m2)
North wall area (m2)
West wall area (m2)
East wall area (m2)
South window area (m2)
North window area (m2)
West window area (m2)
East window area (m2)
Mean DF
Median DF
South PV area (m2)""")
wo = WriteOptions(
    FilePath=path_3,
    ClearDataOverwrite=Toggle(False),
    SaveAfterWrite=Toggle(True),
    CloseAfterWrite=False,
    ColumnStartPosition=1,
    RowStartPosition=1)  # -> UserMessages, WriteOptions

glazing_type = Panel("""0
Starphire - Sungate 400 (3) on Starphire (Argon)
Clear - Solarban 60 (3) (Krypton)
Starphire - Sungate 400 (3) on Starphire - Sungate 400 (5) on Starphire (Krypton)
Clear - Sungate 460 (3) - Sungate 460 (5) (Krypton)""")
material_3 = GetCSLightingMaterial(UnitSystem=4)
material_4 = GetCSLightingMaterial(UnitSystem=4)
item_51 = ListItem(List=glazing_type, Index=glazing, Wrap=True)
glazing_2 = GetCSGlazingAssembly(Search=item_51, UnitSystem=4)
panel_21 = Panel("Multifamily residential")
run = Button()
run_2 = Button()

show_normals_for_check_up_4 = BooleanToggle(True)

rec_2pt_2 = Rectangle2Pt(Plane=extr_2, PointA=item_36, PointB=item_41, Radius=0)  # -> Rectangle, Length
mirror = Mirror(Plane=extr_7)  # -> Geometry, Transform
Y_2 = UnitY(Factor=Slider(50, range=0..50))

brep_14 = Brep(rec_2pt_2.Rectangle)

move2pt_5 = MoveToPoint(Geometry=brep_14, PointA=item_36, PointB=item_38)  # -> Moved, Vector, Transform

move2pt_6 = MoveToPoint(Geometry=move2pt_5.Moved, PointA=item_36, PointB=item_38)  # -> Moved, Vector, Transform
movetoplane_3 = MoveToPlane(Geometry=[move2pt_5.Moved, move2pt_6.Moved], Plane=extr_4, Above=True, Below=True)  # -> Geometry, Transform
move2pt_7 = MoveToPoint(Geometry=move2pt_6.Moved, PointA=item_36, PointB=item_38)  # -> Moved, Vector, Transform

extr_11 = Extrude(Base=[move2pt_6.Moved, move2pt_5.Moved], Direction=Y_2)
capex_4 = CapHolesEx(Brep=extr_11)  # -> Brep, Caps, Solid
trim_3 = TrimSolid(Shape=extr_2, Cutters=capex_4.Brep)

trim_4 = TrimSolid(Shape=extr_4, Cutters=capex_4.Brep)

depth_of_loggia_m = Panel("""0
2.4
1.2
0
-1.2""")
item_52 = ListItem(List=depth_of_loggia_m, Index=balcony_depth_m, Wrap=True)
smaller_5 = SmallerThan(FirstNumber=balcony_depth_m, SecondNumber=Slider(3, range=0..10))  # -> SmallerThan, OrEqualTo

vec = VectorXYZ(XComponent=0, YComponent=item_52, ZComponent=0)  # -> Vector, Length
move_12 = Move(Geometry=move2pt_5.Moved, Motion=vec.Vector)  # -> Geometry, Transform
mirror_2 = Mirror(Geometry=move_12.Geometry, Plane=extr_6)  # -> Geometry, Transform
mirror_3 = Mirror(Geometry=move_12.Geometry, Plane=extr_7)  # -> Geometry, Transform
mirror_4 = Mirror(Geometry=mirror_3.Geometry, Plane=extr_6)  # -> Geometry, Transform

number_slider_20 = Slider(4, range=0..10)
Y_3 = UnitY(Factor=item_52)
move_13 = Move(Geometry=[move2pt_2.Moved, move2pt_3.Moved], Motion=Y_3)  # -> Geometry, Transform
larger_7 = LargerThan(FirstNumber=balcony_depth_m, SecondNumber=number_slider_20)  # -> LargerThan, OrEqualTo
smaller_6 = SmallerThan(FirstNumber=balcony_depth_m, SecondNumber=number_slider_20)  # -> SmallerThan, OrEqualTo
gate_8 = StreamGate(Stream=[move2pt_2.Moved, move2pt_3.Moved], Gate=larger_7.OrEqualTo)  # -> Target0, Target1
gate_9 = StreamGate(Stream=move_13.Geometry, Gate=smaller_6.SmallerThan)  # -> Target0, Target1
brep_15 = Brep(gate_8.Target1)
brep_16 = Brep(gate_9.Target1)

move_14 = Move(Geometry=[move2pt_2.Moved, move2pt_3.Moved], Motion=vec.Vector)  # -> Geometry, Transform
# South windows
brep_17 = Brep(flatten([move2pt_4.Moved, move2pt.Moved, brep_15, brep_16]))
area_16 = Area(Geometry=flatten(brep_17))  # -> flatten(Area), Centroid
ma_10 = MassAddition(Input=area_16.Area)  # -> Result, PartialResults
# North windows
mirror_5 = Mirror(Geometry=brep_17, Plane=extr_6)  # -> Geometry, Transform

# ----
# Glazing
number_slider_21 = Slider(1, range=0..1)
area_17 = Area(Geometry=brep_17)  # -> Area, Centroid
subtraction_6 = Subtraction(A=number_slider_21, B=frame_to_window_ratio)
sqrt_2 = SquareRoot(Value=subtraction_6)
scale = Scale(Geometry=brep_17, Center=area_17.Centroid, Factor=sqrt_2)  # -> Geometry, Transform

# ----
# East glazing
scale_2 = Scale(Geometry=movetoplane_2.Geometry, Center=area_6.Centroid, Factor=sqrt_2)  # -> Geometry, Transform
# West glazing
scale_3 = Scale(Geometry=brep_5, Center=area_7.Centroid, Factor=sqrt_2)  # -> Geometry, Transform
flip_2 = Flip(Surface=scale_3.Geometry)  # -> Surface, Result
gate_10 = StreamGate(Stream=mirror_5.Geometry, Gate=larger_3.OrEqualTo)  # -> Target0, Target1
# North windows
brep_18 = Brep(gate_10.Target1)

# ----
# Window opening (2nd floor)
# Window opening (1st floor)
brep_19 = Brep([brep_17, brep_18, brep_7, brep_11])
# Window opening
move_15 = Move(Geometry=brep_19, Motion=Z)  # -> Geometry, Transform

area_18 = Area(Geometry=[move_15.Geometry, brep_19])  # -> flatten(Area), Centroid
panel_22 = Panel(area_18.Area)
ma_11 = MassAddition(Input=panel_22)  # -> Result, PartialResults
window_area_m2 = Panel(ma_11.Result)
multiplication_22 = Multiplication(A=window_area_m2, B=frame_to_window_ratio)
frame_area_m2 = Panel(multiplication_22)
subtraction_7 = Subtraction(A=window_area_m2, B=multiplication_22)
glazing_area_m2 = Panel(subtraction_7)
winodw_area = Panel(window_area_m2)
preview_2 = CustomPreview(Geometry=[move_15.Geometry, brep_19], Material=ColourSwatch(SwatchColor=RGB(63, 97, 102)))
brep_20 = Brep(brep_18)
area_19 = Area(Geometry=flatten(brep_20))  # -> flatten(Area), Centroid
ma_12 = MassAddition(Input=area_19.Area)  # -> Result, PartialResults
check_win_orien_4 = CheckWinOrien(srf=flatten(brep_20))  # -> P, N, num_2, i

normal_vectors_4 = NormalVectors(S=check_win_orien_4.P, G=show_normals_for_check_up_4, V=check_win_orien_4.N, G_2=show_normals_for_check_up_4)  # -> _0, _1, _0_2, _1_2
vdis_8 = VectorDisplay(Anchor=normal_vectors_4._1, Vector=normal_vectors_4._1_2)
# North windows
vdis_9 = VectorDisplay(Anchor=normal_vectors_4._0, Vector=normal_vectors_4._0_2)

area_20 = Area(Geometry=brep_18)  # -> Area, Centroid
scale_4 = Scale(Geometry=brep_18, Center=area_20.Centroid, Factor=sqrt_2)  # -> Geometry, Transform
scale_5 = Scale(Geometry=brep_11, Center=area_10.Centroid, Factor=sqrt_2)  # -> Geometry, Transform
scale_6 = Scale(Geometry=brep_7, Center=area_11.Centroid, Factor=sqrt_2)  # -> Geometry, Transform
flip_3 = Flip(Surface=scale_6.Geometry)  # -> Surface, Result

# ---- group: Glazing surfaces
glazings = Brep([scale.Geometry, scale_4.Geometry, scale_5.Geometry, flip_3.Surface])

# ----
area_21 = Area(Geometry=flatten(brep_17))  # -> Area, Centroid
area_22 = Area(Geometry=flatten(brep_18))  # -> Area, Centroid
ma_13 = MassAddition(Input=area_21.Area)  # -> Result, PartialResults
ma_14 = MassAddition(Input=area_22.Area)  # -> Result, PartialResults
multiplication_23 = Multiplication(A=ma_14.Result, B=number_slider_19)
multiplication_24 = Multiplication(A=ma_13.Result, B=number_slider_19)

window = ConstructCSWindow(
    Glazing=glazing_2,
    WovenShade=item_28,
    Surface=glazings,
    Input_0_Hidden=False,
    Input_0_Name="Glazing",
    Input_1_Hidden=False,
    Input_1_Name="WovenShade",
    Input_2_Hidden=False,
    Input_2_Name="Position",
    Input_3_Hidden=True,
    Input_3_Name="Rotation",
    Input_4_Hidden=False,
    Input_4_Name="Position Schedule",
    Input_5_Hidden=True,
    Input_5_Name="Rotation Schedule",
    Input_6_Hidden=True,
    Input_6_Name="ECGlass",
    Input_7_Hidden=True,
    Input_7_Name="Tint",
    Input_8_Hidden=True,
    Input_8_Name="Tint Schedule",
    Input_9_Hidden=False,
    Input_9_Name="Surface",
    Mode=0,
    UnitSystem=4)  # -> flatten(Window)

# ----
# Operational impact
# The shading factors are needed to calculate the
# reduction of the solar gains
number_slider_22 = Slider(30, range=0..100)
transparent = GhPythonScript(Horizontwinkel=number_slider_22)  # -> Shading1; inputs Horizontwinkel: Int32, Überhangwinkel: Int32, Seitenblende_winkel1: Int32, Seitenblende_winkel2: Int32
# ---------- transparent: Python ----------
"""Transparent elements
    Input:
       Horizontwinkel (in, optional): Horizon angle
"""

__author__ = "gaalina"
__version__ = "2019.02.07"

import rhinoscriptsyntax as rs

transparent = []

def output():
    if Horizontwinkel!=None: 
        transparent.append(Horizontwinkel)
    else:
        transparent.append(0)
    if Überhangwinkel!=None: 
        transparent.append(Überhangwinkel)
    else:
        transparent.append(0)
    if Seitenblende_winkel1!=None: 
        transparent.append(Seitenblende_winkel1)
    else:
        transparent.append(0)
    if Seitenblende_winkel2!=None: 
        transparent.append(Seitenblende_winkel2)
    else:
        transparent.append(0)
output()

Shading1=transparent

    
#tmp = Uvalue*Area*g_value*Glazing_percentage
#tmp = 5
#orient = Orientation

#Glazed_elements1 = (tmp, orient)
#Glazed_elements1 = (555, 777)

#Glazed_elements1.append(float(tmp))
#Glazed_elements1.append(orient)

#Glazed_elements1.append(11)
#Glazed_elements1.append(22)
###
###
# ---------- end transparent ----------

transparent_2 = GhPythonScript(Horizontwinkel=number_slider_22)  # -> Shading3; inputs Horizontwinkel: Int32, Überhangwinkel: Int32, Seitenblende_winkel1: Int32, Seitenblende_winkel2: Int32
# ---------- transparent_2: Python ----------
"""Transparent elements
    Input:
       Horizontwinkel (in, optional): Horizon angle
"""

__author__ = "gaalina"
__version__ = "2019.02.07"

import rhinoscriptsyntax as rs

transparent = []

def output():
    if Horizontwinkel!=None: 
        transparent.append(Horizontwinkel)
    else:
        transparent.append(0)
    if Überhangwinkel!=None: 
        transparent.append(Überhangwinkel)
    else:
        transparent.append(0)
    if Seitenblende_winkel1!=None: 
        transparent.append(Seitenblende_winkel1)
    else:
        transparent.append(0)
    if Seitenblende_winkel2!=None: 
        transparent.append(Seitenblende_winkel2)
    else:
        transparent.append(0)
output()

Shading3=transparent

    
#tmp = Uvalue*Area*g_value*Glazing_percentage
#tmp = 5
#orient = Orientation

#Glazed_elements1 = (tmp, orient)
#Glazed_elements1 = (555, 777)

#Glazed_elements1.append(float(tmp))
#Glazed_elements1.append(orient)

#Glazed_elements1.append(11)
#Glazed_elements1.append(22)
###
###
# ---------- end transparent_2 ----------
transparent_3 = GhPythonScript(Horizontwinkel=number_slider_22)  # -> Shading3; inputs Horizontwinkel: Int32, Überhangwinkel: Int32, Seitenblende_winkel1: Int32, Seitenblende_winkel2: Int32; same code as transparent_2
transparent_4 = GhPythonScript(Horizontwinkel=number_slider_22)  # -> Shading3; inputs Horizontwinkel: Int32, Überhangwinkel: Int32, Seitenblende_winkel1: Int32, Seitenblende_winkel2: Int32; same code as transparent_2
windows = GhPythonScript(
    Uvalue=python.a,
    Area=ma_10.Result,
    g_value=multiplication_13,
    Glazing_percentage=subtraction_5,
    Orientation=flatten(check_win_orien.i),
    Shading=transparent)  # -> Glazed_elements1; inputs Shading: list
# ---------- windows: Python ----------
"""Windows
    Input:
       U-value: Insert the U-value for the wall
       Area: Insert the area
       g_value: Insert the g-value
       Glazing_percentage: Proportion of glazing in the surface
       Orientation: Orientation
       Shading: Shading factors
"""

__author__ = "gaalina"
__version__ = "2019.02.07"

import rhinoscriptsyntax as rs

Windows = []
W=[]

Windows.append(Uvalue*Area)
Windows.append(Area*g_value*Glazing_percentage/100)
Windows.append(Orientation)

if not Shading:
    Shading = [0, 0, 0, 0]

for i in Windows:
    W.append(i)

for i in Shading:
    if i!=None:
        W.append(i)


#print(W)

Glazed_elements1=W

    
#tmp = Uvalue*Area*g_value*Glazing_percentage
#tmp = 5
#orient = Orientation

#Glazed_elements1 = (tmp, orient)
#Glazed_elements1 = (555, 777)

#Glazed_elements1.append(float(tmp))
#Glazed_elements1.append(orient)

#Glazed_elements1.append(11)
#Glazed_elements1.append(22)
# ---------- end windows ----------
windows_2 = GhPythonScript(
    Uvalue=python.a,
    Area=ma_12.Result,
    g_value=multiplication_13,
    Glazing_percentage=subtraction_5,
    Orientation=flatten(check_win_orien_4.i),
    Shading=transparent_2)  # -> Glazed_elements3; inputs Shading: list
# ---------- windows_2: Python ----------
"""Windows
    Input:
       U-value: Insert the U-value for the wall
       Area: Insert the area
       g_value: Insert the g-value
       Glazing_percentage: Proportion of glazing in the surface
       Orientation: Orientation
       Shading: Shading factors
"""

__author__ = "gaalina"
__version__ = "2019.02.07"

import rhinoscriptsyntax as rs

Windows = []
W=[]

Windows.append(Uvalue*Area)
Windows.append(Area*g_value*Glazing_percentage/100)
Windows.append(Orientation)

if not Shading:
    Shading = [0, 0, 0, 0]

for i in Windows:
    W.append(i)

for i in Shading:
    if i!=None:
        W.append(i)


#print(W)

Glazed_elements3=W

    
#tmp = Uvalue*Area*g_value*Glazing_percentage
#tmp = 5
#orient = Orientation

#Glazed_elements1 = (tmp, orient)
#Glazed_elements1 = (555, 777)

#Glazed_elements1.append(float(tmp))
#Glazed_elements1.append(orient)

#Glazed_elements1.append(11)
#Glazed_elements1.append(22)
# ---------- end windows_2 ----------
windows_3 = GhPythonScript(
    Uvalue=python.a,
    Area=ma_4.Result,
    g_value=multiplication_13,
    Glazing_percentage=subtraction_5,
    Orientation=flatten(check_win_orien_4.i),
    Shading=transparent_3)  # -> Glazed_elements3; inputs Shading: list; same code as windows_2
# West windows
# East windows
windows_4 = GhPythonScript(
    Uvalue=python.a,
    Area=ma_5.Result,
    g_value=multiplication_13,
    Glazing_percentage=subtraction_5,
    Orientation=flatten(check_win_orien_4.i),
    Shading=transparent_4)  # -> Glazed_elements3; inputs Shading: list; same code as windows_2
# South windows
# North windows
panel_23 = Panel(windows)

Z_4 = UnitZ(Factor=Slider(1, range=0..1))

gate_11 = StreamGate(Stream=move_12.Geometry, Gate=smaller_5.SmallerThan)  # -> Target0, Target1
python_7 = GhPythonScript(x=gate_11.Target0, y=pdecon.XComponent, z=pdecon.YComponent, u=pdecon_2.XComponent, v=pdecon_2.YComponent)  # -> out, a, b, c, d
# ---------- python_7: Python ----------
__author__ = "nazanin.rezaei"
__version__ = "2022.07.13"

import rhinoscriptsyntax as rs
if x is not None:
    a=y
    b=z
    c=u
    d=v
# ---------- end python_7 ----------
pt_14 = ConstructPoint(XCoordinate=python_7.a, YCoordinate=python_7.b, ZCoordinate=0)
pt_15 = ConstructPoint(XCoordinate=python_7.c, YCoordinate=python_7.d, ZCoordinate=0)
brep_21 = Brep(gate_11.Target1)
ln_4 = Line(StartPoint=pt_14, EndPoint=pt_15)
# South balcony wall
extr_12 = Extrude(Base=ln_4, Direction=Z)
# North balcony wall
mirror_6 = Mirror(Geometry=extr_12, Plane=extr_6)  # -> Geometry, Transform
brep_22 = Brep(extr_12)

mirror_7 = Mirror(Geometry=brep_21, Plane=extr_7)  # -> Geometry, Transform

mirror_8 = Mirror(Geometry=[brep_21, mirror_7.Geometry], Plane=extr_6)  # -> Geometry, Transform
brep_23 = Brep([brep_21, mirror_7.Geometry])

brep_24 = Brep([trim_4, mirror_6.Geometry, mirror_8.Geometry])
# North trimmed wall
trim_5 = TrimSolid(Shape=brep_24, Cutters=capex.Brep)  # -> flatten(Result)
gate_12 = StreamGate(Stream=mirror_8.Geometry, Gate=larger_2.OrEqualTo)  # -> Target0, Target1
brep_25 = Brep(gate_12.Target1)
debrep_8 = DeconstructBrep(Brep=brep_21)  # -> Faces, Edges, Vertices
trim_6 = TrimSolid(Shape=[brep_22, trim_3, brep_23], Cutters=capex.Brep)
item_53 = ListItem(List=debrep_8.Vertices, Index=Slider(1, range=0..10), Wrap=True)

# ----
# Floor
Z_5 = UnitZ(Factor=Slider(45, range=0..100))

# ----
# Balcony slab
ln_5 = Line(StartPoint=item_38, EndPoint=item_40)
Y_4 = UnitY(Factor=item_52)
extr_13 = Extrude(Base=ln_5, Direction=Y_4)
mirror_9 = Mirror(Geometry=extr_13, Plane=extr_7)  # -> Geometry, Transform

# ----
# Handrails
debrep_9 = DeconstructBrep(Brep=extr_13)  # -> Faces, Edges, Vertices
item_54 = ListItem(List=debrep_9.Edges, Index=Slider(3, range=0..10), Wrap=True)
extr_14 = Extrude(Base=item_54, Direction=Z_4)
mirror_10 = Mirror(Geometry=extr_14, Plane=PlaneYZ(0, 0, 0))  # -> Geometry, Transform
mirror_11 = Mirror(Geometry=[extr_14, mirror_10.Geometry], Plane=extr_6)  # -> Geometry, Transform
item_55 = ListItem(List=debrep_9.Edges, Index=[Slider(0, range=0..100), Slider(1, range=0..10)], Wrap=True)
extr_15 = Extrude(Base=item_55, Direction=Z_4)
mirror_12 = Mirror(Geometry=extr_15, Plane=PlaneYZ(0, 0, 0))  # -> Geometry, Transform
mirror_13 = Mirror(Geometry=[extr_15, mirror_12.Geometry], Plane=extr_6)  # -> Geometry, Transform

debrep_10 = DeconstructBrep(Brep=extr_13)  # -> Faces, Edges, Vertices
item_56 = ListItem(List=debrep_10.Vertices, Index=Slider(0, range=0..10), Wrap=True)
brep_26 = Brep([mirror_9.Geometry, extr_13])

mirror_14 = Mirror(Geometry=brep_26, Plane=extr_6)  # -> Geometry, Transform
gate_13 = StreamGate(Stream=mirror_14.Geometry, Gate=larger_2.OrEqualTo)  # -> Target0, Target1
brep_27 = Brep(gate_13.Target1)

move_16 = Move(Geometry=[extr_13, mirror_14.Geometry], Motion=Z)  # -> Geometry, Transform

# ----
# Balcony slab (2nd floor)
# Balcony slab (1st floor)
brep_28 = Brep([brep_26, brep_27])
# Balcony slabs
move_17 = Move(Geometry=brep_28, Motion=Z)  # -> Geometry, Transform

area_23 = Area(Geometry=[move_17.Geometry, brep_28])  # -> flatten(Area), Centroid
panel_24 = Panel(area_23.Area)
ma_15 = MassAddition(Input=panel_24)  # -> Result, PartialResults
balcony_slabs_area_m2 = Panel(ma_15.Result)
flip_4 = Flip(Surface=[move.Geometry, move_17.Geometry])  # -> flatten(Surface), Result
preview_3 = CustomPreview(Geometry=[move_17.Geometry, brep_28], Material=ColourSwatch(SwatchColor=RGB(105, 101, 94)))

# ----
# Loggia walls
debrep_11 = DeconstructBrep(Brep=brep_14)  # -> Faces, Edges, Vertices
ln_6 = Line(StartPoint=item_56, EndPoint=item_53)
extr_16 = Extrude(Base=ln_6, Direction=Z)
item_57 = ListItem(List=debrep_11.Vertices, Index=0, Wrap=True)
mirror_15 = Mirror(Geometry=extr_16, Plane=extr_7)  # -> Geometry, Transform
mirror_16 = Mirror(Geometry=[mirror_15.Geometry, extr_16], Plane=extr_6)  # -> Geometry, Transform

gate_14 = StreamGate(Stream=mirror_16.Geometry, Gate=larger_2.OrEqualTo)  # -> Target0, Target1
brep_29 = Brep(gate_14.Target1)
gate_15 = StreamGate(Stream=[trim_5, brep_29], Gate=larger_3.OrEqualTo)  # -> Target0, Target1
python_8 = GhPythonScript(x=gate_15.Target0, y=len_3, z=number_slider_9)  # -> out, a, b; same code as python_5
rectangle_5 = Rectangle(Plane=extr_4, XSize=python_8.a, YSize=python_8.b, Radius=0)  # -> Rectangle, Length
# South walls
brep_30 = Brep(flatten([trim_6, mirror_15.Geometry, extr_16]))
# North walls
brep_31 = Brep(flatten(gate_15.Target1))
brep_32 = Brep(rectangle_5.Rectangle)
brep_33 = Brep(flatten([brep_22, brep_23, trim_3, mirror_15.Geometry, extr_16, brep_29, brep_25, brep_31, brep_32, brep_6, brep_9, brep_10, brep_13, brep_18, brep_7, brep_11]))

# ----
# Exterior walls (2nd floor)
# Exterior walls (1st floor)
brep_34 = Brep([brep_31, brep_32, brep_6, brep_9, brep_10, brep_13, trim_6, mirror_15.Geometry, extr_16])
# Exterior walls
move_18 = Move(Geometry=brep_34, Motion=Z)  # -> Geometry, Transform

area_24 = Area(Geometry=[move_18.Geometry, brep_34])  # -> flatten(Area), Centroid
panel_25 = Panel(area_24.Area)
ma_16 = MassAddition(Input=panel_25)  # -> Result, PartialResults
exterior_wall_area_m2 = Panel(ma_16.Result)
addition_4 = Addition(A=exterior_wall_area_m2)  # -> flatten(Result)
addition_5 = Addition(A=addition_4, B=window_area_m2)
wall_area = Panel(addition_4)
preview_4 = CustomPreview(Geometry=[move_18.Geometry, brep_34], Material=ColourSwatch(SwatchColor=RGB(125, 122, 122)))
# Collects windows information
brep_35 = Brep(flatten(brep_34))
# U-value in W/m2*K is the thermal transmittance,
# the rate of transfer of heat through the element,
# divided by the temperature difference across
# the element
area_25 = Area(Geometry=flatten(brep_35))  # -> Area, Centroid
ma_17 = MassAddition(Input=area_25.Area)  # -> Result, PartialResults
panel_26 = Panel(ma_17.Result)
# Sums up all the UA values from the
# components through which we have heat losses
multiplication_25 = Multiplication(A=item_19, B=ma_17.Result)
item_58 = ListItem(List=brep_30, Index=Slider(1, range=0..1), Wrap=True)
item_59 = ListItem(List=brep_30, Index=[Slider(3, range=0..5), Slider(2, range=0..5)], Wrap=True)
gate_16 = StreamGate(Stream=item_58, Gate=larger_6.OrEqualTo)  # -> Target0, Target1
area_26 = Area(Geometry=flatten(brep_30))  # -> Area, Centroid
area_27 = Area(Geometry=flatten([brep_31, brep_32]))  # -> Area, Centroid
brep_36 = Brep(gate_16.Target1)
area_28 = Area(Geometry=[brep_36, item_59])  # -> Area, Centroid
ma_18 = MassAddition(Input=area_28.Area)  # -> Result, PartialResults
ma_19 = MassAddition(Input=area_26.Area)  # -> Result, PartialResults
ma_20 = MassAddition(Input=area_27.Area)  # -> Result, PartialResults
multiplication_26 = Multiplication(A=ma_20.Result, B=number_slider_19)
multiplication_27 = Multiplication(A=ma_19.Result, B=number_slider_19)

scenelayer_2 = ConstructCSSceneLayer(
    Name="WALL",
    Material=material_4,
    Geometry=flatten(brep_33),
    Input_0_Hidden=False,
    Input_0_Name="Name",
    Input_1_Hidden=False,
    Input_1_Name="Material",
    Input_2_Hidden=False,
    Input_2_Name="Geometry",
    Input_3_Hidden=True,
    Input_3_Name="ViewTag",
    UnitSystem=4,
    Input_3_GHParam_Branch0_Path="{0}",
    Input_3_GHParam_Branch0_Item0_null_string=False,
    Input_3_GHParam_Branch0_Item0_string="None")
scenelayer_3 = ConstructCSSceneLayer(
    Name="CEILING",
    Material=material,
    Geometry=flip_4.Surface,
    Input_0_Hidden=False,
    Input_0_Name="Name",
    Input_1_Hidden=False,
    Input_1_Name="Material",
    Input_2_Hidden=False,
    Input_2_Name="Geometry",
    Input_3_Hidden=True,
    Input_3_Name="ViewTag",
    UnitSystem=4,
    Input_3_GHParam_Branch0_Path="{0}",
    Input_3_GHParam_Branch0_Item0_null_string=False,
    Input_3_GHParam_Branch0_Item0_string="None")

extr_17 = Extrude(Base=[brep_26, brep_27], Direction=Z_5)
capex_5 = CapHolesEx(Brep=extr_17)  # -> Brep, Caps, Solid

mirror_17 = Mirror(Geometry=capex_5.Brep, Plane=extr_7)  # -> Geometry, Transform

trim_7 = TrimSolid(Shape=scale2area.Scaled, Cutters=[mirror_17.Geometry, capex_5.Brep])

brep_37 = Brep(flatten(trim_7))

grid = ConstructCSSensorGrid(
    Geometry=brep_37,
    Spacing=Slider(0.4, range=0..1),
    Input_0_Hidden=True,
    Input_0_Name="Building",
    Input_10_Hidden=True,
    Input_10_Name="SupplementalLux",
    Input_11_Hidden=True,
    Input_11_Name="TargetLux",
    Input_12_Hidden=True,
    Input_12_Name="ExcessiveLux",
    Input_13_Hidden=True,
    Input_13_Name="sDA_Time",
    Input_14_Hidden=True,
    Input_14_Name="BREEAMSpaceType",
    Input_15_Hidden=True,
    Input_15_Name="ViewOffset",
    Input_16_Hidden=True,
    Input_16_Name="ViewDirections",
    Input_17_Hidden=True,
    Input_17_Name="ViewRotation",
    Input_18_Hidden=True,
    Input_18_Name="Points Override",
    Input_19_Hidden=True,
    Input_19_Name="Normals Override",
    Input_1_Hidden=False,
    Input_1_Name="Level",
    Input_20_Hidden=True,
    Input_20_Name="Disk Radius",
    Input_21_Hidden=True,
    Input_21_Name="Normal Override",
    Input_2_Hidden=False,
    Input_2_Name="Id"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)
scenelayer_4 = ConstructCSSceneLayer(
    Name="FLOOR",
    Material=material_3,
    Geometry=brep_37,
    Input_0_Hidden=False,
    Input_0_Name="Name",
    Input_1_Hidden=False,
    Input_1_Name="Material",
    Input_2_Hidden=False,
    Input_2_Name="Geometry",
    Input_3_Hidden=True,
    Input_3_Name="ViewTag",
    UnitSystem=4,
    Input_3_GHParam_Branch0_Path="{0}",
    Input_3_GHParam_Branch0_Item0_null_string=False,
    Input_3_GHParam_Branch0_Item0_string="None")
data = Data(flatten([scenelayer_3, scenelayer_4, scenelayer_2, scenelayer]))
daylightmodel = ConstructCSDaylightModel(
    SceneLayers=data,
    Windows=flatten(window),
    SensorGrids=grid,
    NorthOffset=0,
    Input_0_Hidden=False,
    Input_0_Name="SceneLayers",
    Input_1_Hidden=False,
    Input_1_Name="Windows",
    Input_2_Hidden=False,
    Input_2_Name="Luminaires",
    Input_3_Hidden=False,
    Input_3_Name="Tubular Devices",
    Input_4_Hidden=False,
    Input_4_Name="SensorGrids",
    Input_5_Hidden=False,
    Input_5_Name="Camera",
    Input_6_Hidden=False,
    Input_6_Name="North Offset",
    UnitSystem=4)  # -> flatten(Model)
daylight = RunCSDaylight(
    Name=panel_21,
    Model=daylightmodel,
    WeatherFile=path_2,
    Samples=Slider(100, range=0..5000),
    SaveHourly=False,
    Run=run,
    Input_0_Hidden=False,
    Input_0_Name="Name",
    Input_10_Hidden=False,
    Input_10_Name="Run",
    Input_1_Hidden=False,
    Input_1_Name="Model",
    Input_2_Hidden=True,
    Input_2_Name="BldgType",
    Input_3_Hidden=False,
    Input_3_Name="WeatherFile",
    Input_4_Hidden=True,
    Input_4_Name="Ground Albedo",
    Input_5_Hidden=False,
    Input_5_Name="Samples",
    Input_6_Hidden=False,
    Input_6_Name="Save Hourly",
    Input_7_Hidden=True,
    Input_7_Name="Threads",
    Input_8_Hidden=True,
    Input_8_Name="Hide Pop-up",
    Input_9_Hidden=True,
    Input_9_Name="Radiance Params",
    Standard=1,
    UnitSystem=4,
    Input_2_GHParam_Branch0_Path="{0}",
    Input_2_GHParam_Branch0_Item0_null_string=False,
    Input_2_GHParam_Branch0_Item0_string="Office",
    Input_4_GHParam_Branch0_Path="{0}",
    Input_4_GHParam_Branch0_Item0_number=0.2,
    Input_7_GHParam_Branch0_Path="{0}",
    Input_7_GHParam_Branch0_Item0_number=0,
    Input_8_GHParam_Branch0_Path="{0}",
    Input_8_GHParam_Branch0_Item0_boolean=True,
    Input_9_GHParam_Branch0_Path="{0}",
    Input_9_GHParam_Branch0_Item0_null_string=False,
    Input_9_GHParam_Branch0_Item0_string="-ab 6 -lw 0.01")  # -> flatten(Result)
daylight_2 = RunCSDaylight(
    Name=panel_21,
    Model=daylightmodel,
    Samples=Slider(150, range=0..5000),
    Run=run_2,
    Input_0_Hidden=False,
    Input_0_Name="Name",
    Input_10_Hidden=False,
    Input_10_Name="Run",
    Input_1_Hidden=False,
    Input_1_Name="Model",
    Input_2_Hidden=True,
    Input_2_Name="BldgType",
    Input_3_Hidden=True,
    Input_3_Name="WeatherFile",
    Input_4_Hidden=True,
    Input_4_Name="Ground Albedo",
    Input_5_Hidden=False,
    Input_5_Name="Samples",
    Input_6_Hidden=True,
    Input_6_Name="Save Hourly",
    Input_7_Hidden=True,
    Input_7_Name="Threads",
    Input_8_Hidden=True,
    Input_8_Name="Hide Pop-up",
    Input_9_Hidden=True,
    Input_9_Name="Radiance Params",
    Standard=5,
    UnitSystem=4,
    Input_2_GHParam_Branch0_Path="{0}",
    Input_2_GHParam_Branch0_Item0_null_string=False,
    Input_2_GHParam_Branch0_Item0_string="Office",
    Input_3_GHParam_Branch0_Path="{0}",
    Input_3_GHParam_Branch0_Item0_null_string=False,
    Input_3_GHParam_Branch0_Item0_string="USA_MA_Boston-Logan.Intl.AP.725090_TMYx.2004-2018"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)  # -> flatten(Result)
csr = LoadCSResult(
    Result=daylight_2,
    Header=False,
    Output_0_Hidden=False,
    Output_0_Name="Name",
    Output_10_Hidden=True,
    Output_10_Name="Weather",
    Output_11_Hidden=True,
    Output_11_Name="North",
    Output_12_Hidden=True,
    Output_12_Name="LayerNames",
    Output_13_Hidden=True,
    Output_13_Name="LayerObjects",
    Output_14_Hidden=True,
    Output_14_Name="LayerMaterials",
    Output_15_Hidden=True,
    Output_15_Name="Sky",
    Output_1_Hidden=False,
    Output_1_Name="Type",
    Output_2_Hidden=True,
    Output_2_Name="Standard",
    Output_3_Hidden=True,
    Output_3_Name="Date",
    Output_4_Hidden=True,
    Output_4_Name="Version",
    Output_5_Hidden=True,
    Output_5_Name="FileSize",
    Output_6_Hidden=True,
    Output_6_Name="RunLog",
    Output_7_Hidden=False,
    Output_7_Name="Metrics",
    Output_8_Hidden=False,
    Output_8_Name="MetricValues",
    Output_9_Hidden=False,
    Output_9_Name="Grids",
    UnitSystem=4)  # -> Name, Type, Metrics, MetricValues, Grids
previewgrid = PreviewCSSensorGrid(
    Grid=csr.Grids,
    Metric="Daylight factor",
    Input_0_Hidden=False,
    Input_0_Name="Grid",
    Input_1_Hidden=False,
    Input_1_Name="Metric",
    Input_2_Hidden=True,
    Input_2_Name="Falsecolor",
    Input_3_Hidden=True,
    Input_3_Name="Sensor Values",
    Input_4_Hidden=True,
    Input_4_Name="Show Points",
    Input_5_Hidden=True,
    Input_5_Name="Show Edges",
    Input_6_Hidden=True,
    Input_6_Name="Show Labels",
    Input_7_Hidden=True,
    Input_7_Name="Label Format",
    Input_8_Hidden=True,
    Input_8_Name="Transform",
    Output_0_Hidden=True,
    Output_0_Name="Mesh",
    Output_1_Hidden=True,
    Output_1_Name="Texture",
    UnitSystem=4,
    Input_4_GHParam_Branch0_Path="{0}",
    Input_4_GHParam_Branch0_Item0_boolean=True,
    Input_5_GHParam_Branch0_Path="{0}",
    Input_5_GHParam_Branch0_Item0_boolean=True,
    Input_6_GHParam_Branch0_Path="{0}",
    Input_6_GHParam_Branch0_Item0_boolean=False)
panel_27 = Panel(csr.MetricValues)
csr_2 = LoadCSResult(
    Result=daylight,
    Header=False,
    Output_0_Hidden=False,
    Output_0_Name="Name",
    Output_10_Hidden=True,
    Output_10_Name="Weather",
    Output_11_Hidden=True,
    Output_11_Name="North",
    Output_12_Hidden=True,
    Output_12_Name="LayerNames",
    Output_13_Hidden=True,
    Output_13_Name="LayerObjects",
    Output_14_Hidden=True,
    Output_14_Name="LayerMaterials",
    Output_15_Hidden=True,
    Output_15_Name="Sky",
    Output_1_Hidden=False,
    Output_1_Name="Type",
    Output_2_Hidden=True,
    Output_2_Name="Standard",
    Output_3_Hidden=True,
    Output_3_Name="Date",
    Output_4_Hidden=True,
    Output_4_Name="Version",
    Output_5_Hidden=True,
    Output_5_Name="FileSize",
    Output_6_Hidden=True,
    Output_6_Name="RunLog",
    Output_7_Hidden=False,
    Output_7_Name="Metrics",
    Output_8_Hidden=False,
    Output_8_Name="MetricValues",
    Output_9_Hidden=False,
    Output_9_Name="Grids",
    UnitSystem=4)  # -> Name, Type, Metrics, MetricValues, Grids
panel_28 = Panel(csr_2.MetricValues)
previewgrid_2 = PreviewCSSensorGrid(
    Grid=csr_2.Grids,
    Metric="Mean Illuminance (SensorArray) [lux]",
    Input_0_Hidden=False,
    Input_0_Name="Grid",
    Input_1_Hidden=False,
    Input_1_Name="Metric",
    Input_2_Hidden=True,
    Input_2_Name="Falsecolor",
    Input_3_Hidden=True,
    Input_3_Name="Sensor Values",
    Input_4_Hidden=True,
    Input_4_Name="Show Points",
    Input_5_Hidden=True,
    Input_5_Name="Show Edges",
    Input_6_Hidden=True,
    Input_6_Name="Show Labels",
    Input_7_Hidden=True,
    Input_7_Name="Label Format",
    Input_8_Hidden=True,
    Input_8_Name="Transform",
    Output_0_Hidden=True,
    Output_0_Name="Mesh",
    Output_1_Hidden=True,
    Output_1_Name="Texture",
    UnitSystem=4,
    Input_4_GHParam_Branch0_Path="{0}",
    Input_4_GHParam_Branch0_Item0_boolean=True,
    Input_5_GHParam_Branch0_Path="{0}",
    Input_5_GHParam_Branch0_Item0_boolean=True,
    Input_6_GHParam_Branch0_Path="{0}",
    Input_6_GHParam_Branch0_Item0_boolean=False)
item_60 = ListItem(List=panel_27, Index=Slider(0, range=0..100), Wrap=True)
item_61 = ListItem(List=panel_27, Index=Slider(1, range=0..100), Wrap=True)
mean_df = Panel(item_60)
median_df = Panel(item_61)
item_62 = ListItem(List=panel_28, Index=Slider(1, range=0..100), Wrap=True)
item_63 = ListItem(List=panel_28, Index=Slider(2, range=0..100), Wrap=True)
item_64 = ListItem(List=panel_28, Index=Slider(3, range=0..100), Wrap=True)
item_65 = ListItem(List=panel_28, Index=Slider(4, range=0..100), Wrap=True)
sda_time = Panel(item_62)
ase_area = Panel(item_63)
mean_illuminance_lux = Panel(item_64)
blinds_up_time = Panel(item_65)

# ----
# Heated slab (2nd floor)
# Heated slab (1st floor)
brep_38 = Brep(trim_7)
# Slabs
move_19 = Move(Geometry=brep_38, Motion=Z)  # -> Geometry, Transform

area_29 = Area(Geometry=[brep_38, move_19.Geometry])  # -> flatten(Area), Centroid
panel_29 = Panel(area_29.Area)
ma_21 = MassAddition(Input=panel_29)  # -> Result, PartialResults
floor_slabs_heated_area_m2 = Panel(ma_21.Result)
era_m2 = Panel(ma_21.Result)
multiplication_28 = Multiplication(A=era_m2, B=interior_wall_to_floor_area_ratio)
interior_walls_area_m2 = Panel(multiplication_28)
addition_6 = Addition(A=floor_slabs_heated_area_m2, B=balcony_slabs_area_m2)
addition_7 = Addition(A=floor_slabs_heated_area_m2, B=balcony_slabs_area_m2)
area_30 = Area(Geometry=flatten(brep_38))  # -> Area, Centroid
division_8 = Division(A=addition_5, B=era_m2)
ma_22 = MassAddition(Input=area_30.Area)  # -> Result, PartialResults
form_factor = Panel(division_8)
preview_5 = CustomPreview(Geometry=[move_19.Geometry, brep_38], Material=ColourSwatch(SwatchColor=RGB(79, 77, 77)))
area_31 = Area(Geometry=flatten(trim_7))  # -> flatten(Area), Centroid
area_32 = Area(Geometry=flatten(trim_7))  # -> flatten(Area), Centroid
len_5 = Length(Curve=trim_7)
ma_23 = MassAddition(Input=flatten(area_32.Area))  # -> flatten(Result), PartialResults
ma_24 = MassAddition(Input=flatten(area_31.Area))  # -> flatten(Result), PartialResults
multiplication_29 = Multiplication(A=ma_23.Result)
multiplication_30 = Multiplication(A=ma_24.Result, B=item_19)

extr_18 = Extrude(Base=trim_7, Direction=Z)
volume = Volume(Geometry=extr_18)  # -> Volume, Centroid
area_33 = Area(Geometry=trim_7)  # -> Area, Centroid
multiplication_31 = Multiplication(A="0.6", B=volume.Volume)
division_9 = Division(A=multiplication_31, B=area_33.Area)
air_flow_mech_m3_m2h = Panel(division_9)

panel_30 = Panel(ma_24.Result)

addition_8 = Addition(
    ExtWallAboveGr=multiplication_25,
    ExtWallUnderGr=Slider(0, range=0..100),
    FloorSlab=multiplication_30,
    Roof=multiplication_29)
sia_380_1 = Honeybee_Report(
    UA=addition_8,
    Glazed_elements=flatten([windows, windows_2, windows_3, windows_4]),
    category=number_slider_15,
    city_climate=item_49,
    building_case=Slider(1, range=0..1),
    construction_method=Slider(4, range=0..10),
    thermal_bridges=Slider(0.07, range=0..0.1),
    regulation_type=Slider(3, range=0..3),
    ventilation_type=Slider(2, range=0..2),
    air_flow_mech=division_9,
    A_e=panel_30)  # -> transmission_losses, ventilation_losses, heating_demand, port, occupancy_gains, electricity_gains, solar_gains, utilized_gains; inputs Glazed_elements: list, category: Int32, city_climate: Int32, building_case: Int32, construction_method: Int32, regulation_type: Int32, ventilation_type: Int32, heat_recovery: Int32, air_to_earth: Int32, room_num: Int32
# ---------- sia_380_1: Python ----------
"""SIA 380/1
Use this component to calculate the energy demand of a honeybee zone, according to SIA 380-1.
        
-
Provided by Honeybee 0.0.63
        
    Args:
        UA: A sum of UA of all the components
        Opaque_elements_A: Insert the areas of the components
        Glazed_elements: Windows
        north: North direction
        category: Building category: (default=1) 1=Multifamily house 2=Singlefamily huuse 3=Administration 4=School 5=Commersial 6=Restaurant 7=Meeting Venue 8=Hospital 9=Industrial 10=Warehouse 11=Sport facility 12=Indoor pool
        city_climate:Select city for climate data: 1=Wuppertal 2=Aigle 3=Altdorf 4=Basel-Binningen 5=Bern-Liebefeld 6=Buchs-Aarau 7=Chur 8=Davos 9=Disentis 10=Engelberg 11=Genève-Cointrin 12=Glarus 13=Grand-St-Bernhard 14=Güttingen 15=Interlaken 16=La Chaux-de-Fonds 17=La Frétaz 18=Locarno-Monti 19=Lugano 20=Luzern 21=Magadino 22=Montana 23=Neuchâtel 24=Payerne 25=Piotta 26=Pully 27=Robbia 28=Rünenberg 29=Samedan 30=San Bernardino 31=St. Gallen 32=Schaffhausen 33=Scuol 34=Sion 35=Ulrichen 36=Vaduz 37=Wynau 38=Zermatt 39=Zürich-Kloten 40=Zürich-Meteo-Schweiz 
        building_case: (default = 1) New building=1 Renovation=2
        construction_method: Very light=1, Light=2, Medium=3, Heavy=4
        thermal_bridges: Insert percentage of thermal bridges in decimals (example:5%=0.05)
        regulation_type:(default=1) One-room temperature regulation = 1 Refernece room temperature regulation = 2 All Cases = 3 
        ventilation_type: (default=1) Natural=1 Mechanical=2
        air_flow_mech:Number of air flow (mechanical ventilation only) in m3/m2h
        heat_recovery: optional(if mech is on) on=1, off=2 (default)
        heat_exch_efficiency: efficiency of heat exchanger - default = 0.8
        room_num: Optional.Number of living and sleeping rooms (default=1)
        win_percendage: The windows' glass percentage
        b_wall:The b value for underground walls
        b_floor:The b value for underground floors
        A_e: Insert energy reference area (m2)
        Area: Area of the somponents
        orient=Glazed_elements[1]
"""
import rhinoscriptsyntax as rs
import scriptcontext as sc
import uuid
from pprint import pprint
import os
import sys
import System
import Grasshopper.Kernel as gh
        

        
def split_list(alist, wanted_parts=1):
    length = len(alist)
    return [ alist[i*length // wanted_parts: (i+1)*length // wanted_parts] 
             for i in range(wanted_parts) ]
        
            
cat_data=[('Wohnen MFH I',20,40,70,12,28,0.7,0.7,13,15,3.1,20),('Wohnen EFH II',20,60,70,12,22,0.7,0.7,16,15,2.4,25),('Verwaltung III',20,20,80,6,22,0.9,0.7,13,15,3.3,25),('Schulen IV',20,10,70,4,11,0.9,0.7,14,15,2.3,20),('Verkauf V',20,10,90,4,33,0.8,0.7,7,14,0,0),('Restaurants VI',20,5,100,3,33,0.7,1.2,16,15,0,0),('Versammlungslokale VII',20,5,80,3,17,0.8,1.0,18,15,0,0),('Spitaler VIII',22,30,80,16,28,0.7,1.0,18,17,0,0),('Industrie IX',18,20,100,6,17,0.9,0.7,10,14,0,0),('Lager X',18,100,100,6,6,0.9,0.3,14,14,0,0),('Sportbauten XI',18,20,100,6,6,0.9,0.7,16,14,0,0),('Hallenbader XII',28,20,60,4,56,0.7,0.7,15,18,0,0)]
        
if category==None:
    building_category=0
elif category<1 or category>12:
    warningMsg = 'Insert number of Building Category from 1 to 12 '
    ghenv.Component.AddRuntimeMessage(gh.GH_RuntimeMessageLevel.Warning, warningMsg)
#    return
else: 
    building_category= (category-1)
        
#link to data, depending on building category.
        
theta_i=cat_data[building_category][1] #room temperature (Celcius)
area_pers=cat_data[building_category][2] #m2/Person
Heatinput_pers=cat_data[building_category][3] #W/Person
presence_time=cat_data[building_category][4] #hours per day
demand_el_annual=cat_data[building_category][5] #kWh/m2 electricity demand per year
el_reduction=cat_data[building_category][6] #electricity reduction factor 
q_thO=cat_data[building_category][7] #m3/m2h Thermally effective outside air volume flow
Q_H_liO=cat_data[building_category][8] #kWh/m2
DeltaQ_H__li=cat_data[building_category][9] #kWh/m2
Heat_input_standard_useage=cat_data[building_category][10]
Ph_li=cat_data[building_category][11]
util_param=1.0
ref_time_const=15.0 #hours
        
        
#input climate data
climate=[(1,"Adelboden",420,1.7,163,64,78,40,107,2.9,244,106,126,60,181,6.5,362,206,222,96,362,9.4,319,259,251,119,461,14.4,308,319,305,163,592,17.6,293,350,329,189,643,20.2,327,364,354,185,670,20.0,362,327,313,147,573,15.4,355,226,238,101,404,11.2,292,134,161,70,246,5.6,174,67,83,41,122,3.1,150,54,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
        
if city_climate==None:
    warningMsg = 'Insert city for climate data '
    ghenv.Component.AddRuntimeMessage(gh.GH_RuntimeMessageLevel.Warning, warningMsg)
#    return
elif city_climate<1 or city_climate>40:
    warningMsg = 'Insert number of Building Category from 1 to 40 '
    ghenv.Component.AddRuntimeMessage(gh.GH_RuntimeMessageLevel.Warning, warningMsg)
#    return
else: 
    city=(city_climate-1)  #index number in climate  
        
mean_temp= [0,0,0,0,0,0,0,0,0,0,0,0]
j=3
for i in range(12):
    mean_temp[i]=climate[city] [j]
    j=j+6
        
days = [31,28,31,30,31,30,31,31,30,31,30,31]
sea_height=float(climate[city][2])
annual_mean_temp=climate[city][75]
# irradiance table with each row corresponding respectivly to direction: H, SO, SSO, S, SSW, SW, WSW, W, WNW, NW, NNW, N, NNO, NO, ONO, O, OSO
irradiance= range (17)
for i in range (17):
    irradiance[i] = range (12)
        
#horizontal irradiance for each month
j=8
for i in range (12):
    irradiance[0][i]=(climate[city][j])/3.6
    j=j+6
            
k=4
for i in range (12):
    #main orientation
    irradiance[3][i]=(climate[city][k])/3.6 #S
    irradiance[7][i]=(climate[city][k+2])/3.6 #W
    irradiance[11][i]=(climate[city][k+3])/3.6 #N
    irradiance[15][i]=(climate[city][k+1])/3.6 #O
    #middle orientations
    irradiance[1][i]=(irradiance[3][i]*irradiance[15][i])**(1.0/2) #SO
    irradiance[5][i]=(irradiance[3][i]*irradiance[7][i])**(1.0/2) #SW
    irradiance[9][i]= (irradiance[11][i]*irradiance[7][i])**(1.0/2)#NW
    irradiance[13][i]=(irradiance[11][i]*irradiance[15][i])**(1.0/2) #NO
    #second middle orientations
    irradiance[2][i]=(irradiance[3][i]*irradiance[1][i])**(1.0/2) #SSO
    irradiance[4][i]=(irradiance[3][i]*irradiance[5][i])**(1.0/2) #SSW
    irradiance[6][i]=(irradiance[7][i]*irradiance[5][i])**(1.0/2) #WSW
    irradiance[8][i]=(irradiance[7][i]*irradiance[9][i])**(1.0/2) #WNW
    irradiance[10][i]=(irradiance[11][i]*irradiance[9][i])**(1.0/2) #NNW
    irradiance[12][i]=(irradiance[11][i]*irradiance[13][i])**(1.0/2) #NNO
    irradiance[14]=(irradiance[15][i]*irradiance[13][i])**(1.0/2) #ONO
    irradiance[16][i]=(irradiance[15][i]*irradiance[1][i])**(1.0/2) #OSO
            
    k=k+6
        
#new building or renovation
        
if building_case==None:
    build_case=1
elif building_case<1 or building_case>2:
    warningMsg = 'Insert number of Building Case from 1 to 2'
    ghenv.Component.AddRuntimeMessage(gh.GH_RuntimeMessageLevel.Warning, warningMsg)
#    return
else: 
    build_case=building_case
        
#construction method 
                
if construction_method<1 or construction_method>4:
    warningMsg = 'Insert number of construction method from 1 to 4'
    ghenv.Component.AddRuntimeMessage(gh.GH_RuntimeMessageLevel.Warning, warningMsg)
#    return
else: 
    constr_method=construction_method
        
# heat storage capacity C/AE
if constr_method==1:
    constr_factor=0.01
elif constr_method==2:
    constr_factor=0.03
elif constr_method==3:
    constr_factor=0.08
elif constr_method==4:
    constr_factor=0.15
        
#th_bridge= int(raw_input("Insert number of addition for thermal bridges:"))
if thermal_bridges<0 or thermal_bridges>1:
    warningMsg = 'Insert the percendage of thermal bridges in decimal'
    ghenv.Component.AddRuntimeMessage(gh.GH_RuntimeMessageLevel.Warning, warningMsg)
#    return
else: 
    th_brg_add=thermal_bridges
            
#regulation of room temperature - regelung value
        
if regulation_type==None:
    regulation=1
elif regulation_type<1 or regulation_type>3:
    warningMsg = 'Insert number of regulation type from 1 to 3 '
    ghenv.Component.AddRuntimeMessage(gh.GH_RuntimeMessageLevel.Warning, warningMsg)
#    return
else: 
    regulation= regulation_type
        
#Components_out: Name area and Uvalue -> 3
#Windows_out_vertical:Orientation,Area,Uvalue,gValue,glasspercentage,horizon fs1, Overhang fs2, Side fs3.1,Side fs3.2--> 9)
#Windows_out_horizontal:Area,Uvalue,gvalue, glassercentage,horizon S,W,O and N --> 8)
#Components-in:Type, area, Uvalue and b --> 4)
        
        
        
#windows_out_horizontal=range(0) #future alteration
#Total number of components
theta_indoor=theta_i
        
Q_t_monthly=range(12)
i=0 #counts the number of total components for the Q_t calculation
for k in range(12):
   Q_t_monthly[k]=((theta_i+regulation-1)+((theta_indoor-theta_i)/4.0)-mean_temp[k])*days[k]*float(UA)*24/(float(A_e)*1000)

#for y in range (len(windows_out_horizontal)):
#    for n in range(12):
#            Q_t_monthly[i][n]=((theta_i+regulation-1)+((theta_indoor-theta_i)/2.0)-mean_temp[n])*days[n]*float(windows_out_horizontal[y][0])*float(windows_out_horizontal[y][1])*24/(A_e*1000.0)
#    i=i+1
        
Q_t_monthly_wind=[]
Glazing_UA=[]
for i in Glazed_elements[::7]:
    Glazing_UA.append(i)


for k in Glazing_UA:
    for m in range(12):
        Q_t_monthly_wind.append(((theta_i+regulation-1)+((theta_indoor-theta_i)/2.0)-mean_temp[m])*days[m]*k*24/(A_e*1000.0))
glazing_UA_split = split_list(Q_t_monthly_wind, len(Glazing_UA))
glazing_UA_sum=list(map(sum,zip(*glazing_UA_split)))
        
Q_t_m=[]
for x, y in zip(Q_t_monthly, glazing_UA_sum):
    Q_t_m.append(x+y)
        
Q_t_month = range (12)
for i in range (12):
    Q_t_month[i] =0
        
Q_t=0
        
for i in range (12):
    Q_t=Q_t+Q_t_month[i]
"""Heating Load"""
q_th=q_thO
if ventilation_type==None:
    vent_type=1
elif ventilation_type<1 or ventilation_type>2:
    warningMsg = 'Insert number of ventilation_type from 1 to 2 '
    ghenv.Component.AddRuntimeMessage(gh.GH_RuntimeMessageLevel.Warning, warningMsg)
#    return
else: 
    vent_type=ventilation_type
        
if vent_type==2:
    if air_flow_mech==None:
        warningMsg = 'Insert number of air flow for mechanical ventilation in m3/m2h '
        ghenv.Component.AddRuntimeMessage(gh.GH_RuntimeMessageLevel.Warning, warningMsg)
#        return
    else:
        q_th=air_flow_mech
        
design_temp=climate[city][76]
H_comp=UA
        
# heat capacity of air
ra_ca=(1220.0-(0.14*sea_height))/3600.0
H_vent=A_e*q_th*ra_ca
H_tot=H_comp+H_vent
        
Ph=(H_tot*(theta_i-design_temp)/A_e)-Heat_input_standard_useage
        
if design_temp<8:
    Ph_li_corr=Ph_li*(theta_i-design_temp)/(theta_i-(-8))
else:
    Ph_li_corr=Ph_li
            
Ph_li=max(Ph_li,Ph_li_corr)
        
"""Comfort Ventilation""" # in Standard heat recovery is not mentioned-values from the excel SIA_380
        
if heat_recovery==None:
    heat_rec=2
elif heat_recovery<1 or heat_recovery>2:
    warningMsg = 'Insert number for heat recovery from 1 to 2 '
    ghenv.Component.AddRuntimeMessage(gh.GH_RuntimeMessageLevel.Warning, warningMsg)
#    return
else:
    heat_rec=heat_recovery
        
if air_to_earth==None:
    air_earth=2
elif air_to_earth<1 or air_to_earth>2:
    warningMsg = 'Insert number for air_to_earth from 1 to 2 '
    ghenv.Component.AddRuntimeMessage(gh.GH_RuntimeMessageLevel.Warning, warningMsg)
#    return
else:
    air_earth=air_to_earth
        
if room_num==None:
    S_r=1
else:
    S_r=room_num
        
#For comfort ventilation, the standard today is: heat exchangers with a temperature change rate of at least 80%.
h_WRG=0.8
        
if heat_rec==1:
    if heat_exch_efficiency!=None:
        h_WRG=heat_exch_efficiency
           
basic_air_exchangerate=0.15 #m3/m2h
air_exchangerate_step1=S_r*20.0 #m3/h
air_exchangerate_step2=S_r*30.0 #m3/h
air_exchangerate_step3=S_r*45.0 #m3/h0.
operation_timestep1=84 #h/Wo
operation_timestep2=70 #h/Wo
operation_timestep3=14 #h/Wo
        
if air_earth==1:
    thermal_active_airrate_step1=(((1-h_WRG)*(air_exchangerate_step1/A_e))*0.8)+basic_air_exchangerate #m3/m2h
    thermal_active_airrate_step2=(((1-h_WRG)*(air_exchangerate_step2/A_e))*0.8)+basic_air_exchangerate #m3/m2h
    thermal_active_airrate_step3=(((1-h_WRG)*(air_exchangerate_step3/A_e))*0.8)+basic_air_exchangerate #m3/m2h
else:
    thermal_active_airrate_step1=((1-h_WRG)*(air_exchangerate_step1/A_e))+basic_air_exchangerate
    thermal_active_airrate_step2=((1-h_WRG)*(air_exchangerate_step2/A_e))+basic_air_exchangerate
    thermal_active_airrate_step3=((1-h_WRG)*(air_exchangerate_step3/A_e))+basic_air_exchangerate
        
V_EBFo=(thermal_active_airrate_step1*operation_timestep1+thermal_active_airrate_step2*operation_timestep2+thermal_active_airrate_step3*operation_timestep3)/168.0
# 168=84+70+14
Q_V_without=[0,0,0,0,0,0,0,0,0,0,0,0]
Q_V_with=[0,0,0,0,0,0,0,0,0,0,0,0]
if heat_rec==2:
    for i in range(12):
        Q_V_without[i]=((theta_i+regulation-1)-mean_temp[i])*q_thO*days[i]*ra_ca*24.0/1000.0
for i in range (12):
    Q_V_with [i] = (theta_i+regulation-1-mean_temp[i])*V_EBFo*days[i]*A_e*ra_ca*24/(A_e*1000.0)
    if Q_V_with[i]<0:
        Q_V_with[i]=0
                
Q_V_with_Annual = 0
for i in range (12):
    Q_V_with_Annual=Q_V_with_Annual+Q_V_with[i]
        
if heat_rec==2:   
    Q_V_without_Annual = 0
for i in range (12):
    Q_V_without_Annual=Q_V_without_Annual+Q_V_without[i]
            
    diff=Q_V_with_Annual-Q_V_without_Annual
else:
    diff=0.0
        
# Electricity consumption by air exchange rate
el_step1=0.3 #Wh/m3
el_step2=0.35 #Wh/m3
el_step3=0.5 #Wh/m3
        
consumption_step1=air_exchangerate_step1*el_step1*operation_timestep1/1000.0
consumption_step2=air_exchangerate_step2*el_step2*operation_timestep2/1000.0
consumption_step3=air_exchangerate_step3*el_step3*operation_timestep3/1000.0
        
consumption_tot=((consumption_step1+consumption_step2+consumption_step3)*52)/A_e
        
"""Gains"""
#Electricity gains
#duration of calculation period
duration_el=365.0
        
Qi_el=(duration_el*el_reduction*demand_el_annual)/365.0
Qi_el_monthly=[0,0,0,0,0,0,0,0,0,0,0,0]
for i in range (12):
    Qi_el_monthly[i]=Qi_el/12.0
        
#Occupancy gains
duration_occ=365.0
Qi_P=(duration_occ*presence_time*Heatinput_pers)/(area_pers*1000.0)
Qi_P_monthly=[0,0,0,0,0,0,0,0,0,0,0,0]
for i in range (12):
    Qi_P_monthly[i]=Qi_P/12.0
        
#Solar gains
horizon=[("-","SW","SE","SSE","S","SSW","WSW","W","E","WNW","NW","NE","NNW","N","NNE","ENE","ESE"),(0,1,1,1,1,1,1,1,1,1,1,1,1,1,1,1,1),(1,1,1,1,1,1,1,0.99,0.99,1,1,1,1,1,1,1,1),(2,0.99,0.99,0.99,0.99,0.99,0.99,0.99,0.99,1,1,1,1,1,1,1,0.99),(3,0.99,0.99,0.99,0.99,0.99,0.99,0.98,0.98,0.99,0.99,0.99,1,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
overhang=[("-","SW","SE","SSE","S","SSW","WSW","W","E","WNW","NW","NE","NNW","N","NNE","ENE","ESE"),(0,1,1,1,1,1,1,1,1,1,1,1,1,1,1,1,1),(1,1,1,1,1,1,1,1,1,1,1,1,1,1,1,1,1),(2,0.99,0.99,0.99,0.99,0.99,0.99,0.99,0.99,0.99,0.99,0.99,0.99,0.99,0.99,0.99,0.99),(3,0.99,0.99,0.99,0.99,0.99,0.99,0.99,0.99,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
sideblind=[("-","SW","SE","SSE","S","SSW","WSW","W","E","WNW","NW","NE","NNW","N","NNE","ENE","ESE"),(0,1,1,1,1,1,1,1,1,1,1,1,1,1,1,1,1),(1,1,1,1,1,1,1,1,1,1,1,1,1,1,1,1,1),(2,1,1,1,1,1,1,0.99,0.99,1,1,1,1,1,1,1,1),(3,0.99,0.99,0.99,0.99,0.99,0.99,0.99,0.99,1,1,1,1,1,1,1,0.99),(4,0.99,0.99,0.99,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
        
Qi_s_monthly=[]
Glazing_gA=[]
for i in Glazed_elements[1::7]:
    Glazing_gA.append(i)
        
orientation=[]
for i in Glazed_elements[2::7]:
    orientation.append(i)

y=[]
for i in Glazed_elements[3::7]:
    y.append(i)

           
z=[]
for i in Glazed_elements[4::7]:
    z.append(i)
            
j=[]
for i in Glazed_elements[5::7]:
    j.append(i)
        
n=[]
for i in Glazed_elements[6::7]:
    n.append(i)

t=[]
t.append(orientation)
t.append(y) 
t.append(z)
t.append(j)
t.append(n)

        
fs11=[]
fs22=[]
fs31=[]
fs32=[]



for i in t[0]:
    index_h=horizon[0].index(i)
    index_o=overhang[0].index(i)
    index_s=sideblind[0].index(i)
    irradiance_orient=[("H","SE","SSE","S","SSW","SW","WSW","W","WNW","NW","NNW","N","NNE","NE","ENE","E","ESE")]
    index_ir=irradiance_orient[0].index(i)
        
for h in t[1]:
    hor=h
    if hor==0:
        fs1=1
    elif hor<1:
        fs1=hor
    else:
        fs1=horizon[hor+1][index_h]
    fs11.append(fs1)
for k in t[2]:
    over=k
    fs2=overhang[over+1][index_o]
    fs22.append(fs2)
for side1 in t[3]:
    fs3_1=sideblind[side1+1][index_s]
    fs31.append(fs3_1)
for side2 in t[4]:
    for i in t[0]:
        if i=="SW" or i=="SE" or i=="S" or i=="SSW" or i=="SSE":
            fs3_2=sideblind[side2+1][index_s]
        else:
            fs3_2=1
        fs32.append(fs3_2)
for fs1, fs2, fs3_1, fs3_2,k in zip(fs11, fs22, fs31, fs32, Glazing_gA):
    for j in range(12):
        Qi_s_monthly.append((irradiance[index_ir][j])*k*0.9*fs1*fs2*fs3_1*fs3_2/A_e)

glazing_gA_split = split_list(Qi_s_monthly, len(Glazing_gA))
glazing_gA_sum=list(map(sum,zip(*glazing_gA_split)))
        
        
    #       k=i+1
    #for n in range(len(windows_out_horizontal)):
    #    horS=int(windows_out_horizontal[n][4])
    #    horW=int(windows_out_horizontal[n][5])
    #    horO=int(windows_out_horizontal[n][6])
    #    horN=int(windows_out_horizontal[n][7])
    #    fs1=horizon[horS+1] [4]
    #    fs2=horizon[horW+1] [7]
    #    fs3_1=horizon[horO+1][8]
    #    fs3_2=horizon[horN+1][13]
    #    for j in range(12):
    #        m=k+n
    #        Qi_s_monthly[m][j]=(irradiance[0][j])*float(windows_out_horizontal[n][0])*float(windows_out_horizontal[n][2])*float(windows_out_horizontal[n][3])*0.9*fs1*fs2*fs3_1*fs3_2/A_e
        
        
        
"""Balance"""
#transmission losses
Q_Tr_month=[0,0,0,0,0,0,0,0,0,0,0,0]
#total loses=transmission +ventilation losses
Q_tot_month=[0,0,0,0,0,0,0,0,0,0,0,0]
#total gains
Q_g_month=[0,0,0,0,0,0,0,0,0,0,0,0]
#g Heat input/heat loss ratio
g_month=[0,0,0,0,0,0,0,0,0,0,0,0]
#t_const time constant
t_const_month=[0,0,0,0,0,0,0,0,0,0,0,0]
#heat losses coefficient
H_coeff_month=[0,0,0,0,0,0,0,0,0,0,0,0]
#Parameter for utilization
a_util=[0,0,0,0,0,0,0,0,0,0,0,0]
#Utilization of heat input
hg_case1=[0,0,0,0,0,0,0,0,0,0,0,0]
hg_case2=[0,0,0,0,0,0,0,0,0,0,0,0]
hg_decision=[0,0,0,0,0,0,0,0,0,0,0,0]
#Utilized gains
Q_ug_month=[0,0,0,0,0,0,0,0,0,0,0,0]
#Heating demand
Q_Heating_month=[0,0,0,0,0,0,0,0,0,0,0,0]
        
for i in range(12):
    Q_Tr_month[i]=Q_t_m[i]+Q_t_m[i]*th_brg_add
    if heat_rec==2:
        Q_tot_month[i]=Q_Tr_month[i]+Q_V_without[i]
    else:
        Q_tot_month[i]=Q_Tr_month[i]+Q_V_with[i]
    Q_g_month[i]=Qi_P_monthly[i]+Qi_el_monthly[i]+glazing_gA_sum[i]
    g_month[i]=Q_g_month[i]/Q_tot_month[i]   

    t_const_month[i]=constr_factor*A_e*1000.0/(H_comp+q_thO*A_e*ra_ca)
    H_coeff_month[i]=(UA+q_thO*A_e*ra_ca/3600.0)*(1+th_brg_add)
    a_util[i]=util_param+t_const_month[i]/ref_time_const
    if Q_tot_month[i]>0:
        hg_case1[i]=1
    else:
        hg_case1[i]=0
    if g_month[i]==1:
        hg_case2[i]=util_param/(util_param+1)
    else:
        hg_case2[i]=(1-((g_month[i])**(a_util[i])))/(1-((g_month[i])**((a_util[i])+1)))
    if hg_case1[i]==0:
        hg_decision[i]=0
    else:
        hg_decision[i]=hg_case2[i]
    Q_ug_month[i]=Q_g_month[i]*hg_decision[i]
    Q_Heating_month[i]=Q_tot_month[i]-Q_ug_month[i]
        
Q_Heating=0
for i in range (12):
    Q_Heating=Q_Heating+Q_Heating_month[i]
        
corr_factor_mean_temp=(1--1*(0.06*(9.4-annual_mean_temp)))
"""
if build_case==1:
    Q_H_li=corr_factor_mean_temp*(Q_H_liO+DeltaQ_H__li*(Opaque_elements_A/A_e))
    Q_H_ta=Q_H_li*0.6
else:
    Q_H_li=corr_factor_mean_temp*(Q_H_liO+DeltaQ_H__li*(A_th/A_e))*1.5
    Q_H_ta=Q_H_li/1.5

perc=Q_Heating/Q_H_li
"""
        
if heat_rec==2:
    results=[Q_Heating_month,Q_Tr_month,Q_V_without,Qi_P_monthly,Qi_el_monthly,glazing_gA_sum,Q_ug_month]
else:
    results=[Q_Heating_month,Q_Tr_month,Q_V_with,Qi_P_monthly,Qi_el_monthly,glazing_gA_sum,Q_ug_month]
        
        
        
results_energy=results
heating_demand=results_energy[0]
transmission_losses=results_energy[1]
ventilation_losses=results_energy[2]
occupancy_gains=results_energy[3]
electricity_gains=results_energy[4]
solar_gains=results_energy[5]
utilized_gains=results_energy[6]
# ---------- end sia_380_1 ----------

ma_25 = MassAddition(Input=sia_380_1.heating_demand)  # -> Result, PartialResults
ma_26 = MassAddition(Input=sia_380_1.transmission_losses)  # -> Result, PartialResults
ma_27 = MassAddition(Input=sia_380_1.ventilation_losses)  # -> Result, PartialResults
ma_28 = MassAddition(Input=sia_380_1.solar_gains)  # -> Result, PartialResults
ma_29 = MassAddition(Input=sia_380_1.utilized_gains)  # -> Result, PartialResults
ma_30 = MassAddition(Input=sia_380_1.electricity_gains)  # -> Result, PartialResults
ma_31 = MassAddition(Input=sia_380_1.occupancy_gains)  # -> Result, PartialResults
division_10 = Division(A=ma_27.Result, B=number_slider_17)
division_11 = Division(A=ma_26.Result, B=number_slider_17)
division_12 = Division(A=ma_31.Result, B=number_slider_17)
division_13 = Division(A=ma_30.Result, B=number_slider_17)
division_14 = Division(A=ma_28.Result, B=number_slider_17)
division_15 = Division(A=ma_29.Result, B=number_slider_17)
division_16 = Division(A=ma_25.Result, B=number_slider_17)
panel_31 = Panel(division_16)
division_17 = Division(A=division_16, B=multiplication_17)
heating_consumption_kwh_m2_y = Panel(division_17)
multiplication_32 = Multiplication(A=heating_consumption_kwh_m2_y, B=conversion_factors_kg_co2_eq_kwh)
heating_consumption_gwp_kg_co2_eq_m2_y = Panel(multiplication_32)

ventilation_efficiency_in_power_w_m3h = Panel("0.2")
hours_per_day = Panel("8760")
multiplication_33 = Multiplication(A=ventilation_efficiency_in_power_w_m3h, B=hours_per_day, C=multiplication_31)
division_18 = Division(A=multiplication_33, B="1000")
multiplication_34 = Multiplication(A=division_18, B="1")

division_19 = Division(A=multiplication_34, B=area_33.Area)

ventilation_consumption_kwh_m2 = Panel(division_19)
multiplication_35 = Multiplication(A=ventilation_consumption_kwh_m2, B="0.102")
ventilation_consumption_gwp_kg_co2_eq_m2 = Panel(multiplication_35)

entwine = Entwine(
    Branch00=division_16,
    Branch01=heating_consumption_kwh_m2_y,
    Branch03=division_11,
    Branch04=division_10,
    Branch05=division_12,
    Branch06=division_13,
    Branch07=division_14,
    Branch08=division_15,
    Branch09=ventilation_consumption_kwh_m2,
    Branch010=ventilation_consumption_gwp_kg_co2_eq_m2,
    Branch011=exterior_wall_area_m2,
    Branch012=window_area_m2,
    Branch013=window_area_m2,
    Branch014=glazing_area_m2,
    Branch015=frame_area_m2,
    Branch016=interior_walls_area_m2,
    Branch017=era_m2,
    Branch018=roof_area_m2,
    Branch019=balcony_slabs_area_m2,
    Branch020=required_insulation_thickness_m,
    Branch021=required_gf_slab_insulation_thickness_m,
    Branch022=len_5,
    Branch023=sda_time,
    Branch024=ase_area,
    Branch025=mean_illuminance_lux,
    Branch026=blinds_up_time,
    Branch027=multiplication_27,
    Branch028=multiplication_26,
    Branch029=multiplication_21,
    Branch030=multiplication_18,
    Branch031=multiplication_24,
    Branch032=multiplication_23,
    Branch033=multiplication_19,
    Branch034=multiplication_20,
    Branch035=mean_df,
    Branch036=median_df,
    Branch037=ma_18.Result,
    FlattenInputs=True)
panel_32 = Panel(entwine)
rec = DataRecorder(entwine, DataLimit=-10, RecordData=False)
writexl = WriteToExcel(
    Run=Toggle(False),
    ExcelWorksheet="1",
    ColumnNames=panel_20,
    WriteOptions=wo.WriteOptions,
    ColumnnsOrRows=Toggle(False),
    DataToWriteIntoColumns=rec)
panel_33 = Panel(writexl)

panel_34 = Panel(rec)

# ==== cluster CheckWinOrien
srf = ClusterInput()

srf_2 = Surface(srf)
area = Area(Geometry=srf_2)  # -> Area, Centroid
srf_cp = SurfaceClosestPoint(Point=area.Centroid, Surface=srf_2)  # -> Point, UVPoint, Distance
evalsrf = EvaluateSurface(Surface=srf_2, Point=srf_cp.UVPoint)  # -> Point, Normal, UDirection, VDirection, Frame

P = ClusterOutput(evalsrf.Point)
N = ClusterOutput(evalsrf.Normal)
num = Number(area.Area)
num_2 = ClusterOutput(num)

# ---- group: Normal Vectors of Parts
vec = Vector(evalsrf.Normal)

# ----
compass_points = ValueList({"cardinal": 4, "intercardinal": 8, "16-Wind": 16, "32-Wind": 32}, selected="cardinal")
xy = XYPlane(Origin=Point(0, 0, 0))
tolerance_of_vertical_parts = Panel("0")
bool = Boolean(True)
xz = XZPlane(Origin=Point(0, 0, 0))
Z = UnitZ(Factor=1)

# ---- group: Baseplane
pln = Plane(xy)

# ---- group: Rotation Angle
num_3 = Number(Slider(90, range=0..180))

# ---- group: Compass Points
int = Integer(compass_points)

# ---- group: Direction Areas
range = Range(Domain="0 to 2*Pi", Steps=int)
consec = ConsecutiveDomains(Numbers=range, Additive="False")

# ---- group: Size
num_4 = Number(Slider(7.5, range=0..10))

# ----
rad = Radians(Degrees=num_3)
prot = RotatePlane(Plane=xy, Angle=rad)
expression = Expression(x=int, Expression="0-(π/x)")
deplane = DeconstructPlane(Plane=prot)  # -> Origin, XAxis, YAxis, ZAxis
c_script = CSharpScript(V1=vec, V2=deplane.XAxis, t=tolerance_of_vertical_parts)  # -> out, CD, H; inputs V1: Vector3d, V2: Vector3d, t: Double
# ---------- c_script: C# ----------
    /* Test, ob Vektor V1 parallel zu Vektor V2 ist
    (-1 = Parallel(aber in entgegengesetzte Richtung), 0 = nicht Parallel, 1 = Parallel)
    (t = Winkel in dem der Vektor als parallel gilt)*/


    if(V1.IsParallelTo(V2, t) == 0)
    {
      CD = true;
    }

    else
    {
      CD = false;
    }

    if(V1.IsParallelTo(V2, t) == -1 || V1.IsParallelTo(V2, t) == 1)
    {
      H = 1;
    }

    else
    {
      return;
    }
# ---------- end c_script ----------
c_script_2 = CSharpScript(V1=vec, V2=deplane.ZAxis, t=tolerance_of_vertical_parts)  # -> out, CD, H; inputs V1: Vector3d, V2: Vector3d, t: Double; same code as c_script
vrot = Rotate(Vector=deplane.XAxis, Axis=deplane.ZAxis, Angle=expression)
cull = CullPattern(List=vec, CullPattern=c_script.CD)
cull_2 = CullPattern(List=vec, CullPattern=c_script_2.CD)
clean = CleanTree(Tree=c_script_2.H, CleanInvalid=True, CleanEmpty=bool)
angle = Angle(VectorA=Z, VectorB=cull, Plane=xz)  # -> Angle, Reflex
compass = Compass(baseplane=prot, compass_points=int, size=num_4)

# ---- group: North Start
vec_2 = Vector(vrot)

# ----
multiplication = Multiplication(A=clean, B=int)
python = GhPythonScript(x=clean, y=multiplication)  # -> out, a
# ---------- python: Python ----------
__author__ = "ahollber"
__version__ = "2019.03.19"

import rhinoscriptsyntax as rs

if x==None:
    a=None
else:
    a=y
# ---------- end python ----------
clean_2 = CleanTree(RemoveNulls=True, RemoveInvalid=True, RemoveEmpty=False, Tree=python.a)

angle_2 = Angle(VectorA=vec_2, VectorB=cull_2, Plane=prot)  # -> Angle, Reflex
fdom = FindDomain(Domains=consec, Number=angle_2.Angle, Strict=False)  # -> Index, Neighbour
merge = Merge(Data1=simplify(clean_2), Data2=simplify(fdom.Index))
item = ListItem(List=compass, Index=merge, Wrap=True)  # -> flatten(Item)

i = ClusterOutput(item)

# ==== cluster NormalVectors
size_of_normal_s_if_shown = Slider(1, range=0..1)
V = ClusterInput()
S = ClusterInput()
G = ClusterInput()
amp = Amplitude(Vector=V, Amplitude=size_of_normal_s_if_shown)
G_2 = ClusterInput()
gate = StreamGate(Stream=S, Gate=G)  # -> Target0, Target1
gate_2 = StreamGate(Stream=amp, Gate=G_2)  # -> Target0, Target1
_0 = ClusterOutput(gate.Target0)
_1 = ClusterOutput(gate.Target1)
_0_2 = ClusterOutput(gate_2.Target0)
_1_2 = ClusterOutput(gate_2.Target1)

# ==== cluster Cluster
x = ClusterInput()
cube = Cube(Value=x)
sqr = Square(Value=x)
sqr_2 = Square(Value=x)
sqr_3 = Square(Value=x)
cube_2 = Cube(Value=x)
sqr_4 = Square(Value=x)
cube_3 = Cube(Value=x)
cube_4 = Cube(Value=x)
multiplication = Multiplication(A=sqr_4, B=Slider(0.6426, range=0..1))
multiplication_2 = Multiplication(A=x, B=Slider(0.6365, range=0..1))
multiplication_3 = Multiplication(A=cube_2, B=Slider(0.4068, range=0..1))
multiplication_4 = Multiplication(A=sqr_3, B=sqr_2, C=Slider(0.1536, range=0..1))
multiplication_5 = Multiplication(A=cube, B=sqr, C=Slider(0.0315, range=0..0.1))
multiplication_6 = Multiplication(A=cube_3, B=cube_4, C=Slider(0.0027, range=0..0.01))
subtraction = Subtraction(A=multiplication_6, B=multiplication_5)
addition = Addition(A=subtraction, B=multiplication_4)
subtraction_2 = Subtraction(A=addition, B=multiplication_3)
addition_2 = Addition(A=subtraction_2, B=multiplication)
subtraction_3 = Subtraction(A=addition_2, B=multiplication_2)
R = ClusterOutput(subtraction_3)

# ==== cluster Cluster_2
x = ClusterInput()
cube = Cube(Value=x)
cube_2 = Cube(Value=x)
cube_3 = Cube(Value=x)
sqr = Square(Value=x)
sqr_2 = Square(Value=x)
sqr_3 = Square(Value=x)
cube_4 = Cube(Value=x)
sqr_4 = Square(Value=x)
multiplication = Multiplication(A=x, B=Slider(0.7719, range=0..1))
multiplication_2 = Multiplication(A=sqr_4, B=Slider(0.5819, range=0..1))
multiplication_3 = Multiplication(A=cube_4, B=sqr_3, C=Slider(0.0035, range=0..0.01))
multiplication_4 = Multiplication(A=cube, B=cube_2, C=Slider(0.0012, range=0..0.01), D=Slider(-1, range=-10..100))
multiplication_5 = Multiplication(A=cube_3, B=Slider(0.2354, range=0..1))
multiplication_6 = Multiplication(A=sqr, B=sqr_2, C=Slider(0.0366, range=0..0.1))
addition = Addition(A=multiplication_4, B=multiplication_3)
addition_2 = Addition(A=addition, B=multiplication_6)
subtraction = Subtraction(A=addition_2, B=multiplication_5)
addition_3 = Addition(A=subtraction, B=multiplication_2)
subtraction_2 = Subtraction(A=addition_3, B=multiplication)
R = ClusterOutput(subtraction_2)

# ==== cluster Compass: creates a Compass-Rose
baseplane = ClusterInput()  # Baseplane for Compass
compass_points = ClusterInput()  # Division of Compass (cardinal = 4, intercardinal = 8, 16-Wind = 16, 32-Wind = 32) )
size = ClusterInput()  # Size of Compass

# ---- group: Compass / Baseplane
pln = Plane(baseplane)

# ---- group: Compass / Size
num = Number(size)

# ---- group: Compass / Compass Points
int = Integer(compass_points)

# ---- group: Compass
cir = Circle(Plane=pln, Radius=expr("x/2", num))
pi = Pi(Factor=expr("-1/x", int))
end = EndPoints(Curve=cir)  # -> Start, End
rotate = Rotate(Geometry=cir, Angle=pi, Plane=pln)  # -> Geometry, Transform
divide = DivideCurve(Curve=rotate.Geometry, Count=int, Kinks=False)  # -> Points, Tangents, Parameters
shatter = Shatter(Curve=rotate.Geometry, Parameters=divide.Parameters)
eval = EvaluateLength(Curve=shatter, Length=0.5, Normalized=True)  # -> Point, Tangent, Parameter
c_script = CSharpScript(CP=int)  # -> out, WD; inputs CP: Int32
# ---------- c_script: C# ----------
    List<String> Directions = new List<String>();

    if (CP == 4)
    {
      Directions.Add("N");
      Directions.Add("W");
      Directions.Add("S");
      Directions.Add("E");
      WD = Directions;
    }

    else if (CP == 8)
    {
      Directions.Add("N");
      Directions.Add("NW");
      Directions.Add("W");
      Directions.Add("SW");
      Directions.Add("S");
      Directions.Add("SE");
      Directions.Add("E");
      Directions.Add("NE");
      WD = Directions;
    }

    else if (CP == 16)
    {
      Directions.Add("N");
      Directions.Add("NNW");
      Directions.Add("NW");
      Directions.Add("WNW");
      Directions.Add("W");
      Directions.Add("WSW");
      Directions.Add("SW");
      Directions.Add("SSW");
      Directions.Add("S");
      Directions.Add("SSE");
      Directions.Add("SE");
      Directions.Add("ESE");
      Directions.Add("E");
      Directions.Add("ENE");
      Directions.Add("NE");
      Directions.Add("NNE");
      WD = Directions;
    }

    else if (CP == 32)
    {
      Directions.Add("N");
      Directions.Add("NbW");
      Directions.Add("NNW");
      Directions.Add("NWbN");
      Directions.Add("NW");
      Directions.Add("NWbW");
      Directions.Add("WNW");
      Directions.Add("WbN");
      Directions.Add("W");
      Directions.Add("WbS");
      Directions.Add("WSW");
      Directions.Add("SWbW");
      Directions.Add("SW");
      Directions.Add("SWbS");
      Directions.Add("SSW");
      Directions.Add("SbW");
      Directions.Add("S");
      Directions.Add("SbE");
      Directions.Add("SSE");
      Directions.Add("SEbS");
      Directions.Add("SE");
      Directions.Add("SEbE");
      Directions.Add("ESE");
      Directions.Add("EbS");
      Directions.Add("E");
      Directions.Add("EbN");
      Directions.Add("ENE");
      Directions.Add("NEbE");
      Directions.Add("NE");
      Directions.Add("NEbN");
      Directions.Add("NNE");
      Directions.Add("NbE");
      WD = Directions;
    }

    else
    {
      return;
    }
# ---------- end c_script ----------
expression = Expression(x=int, y=num, Expression="y/(x*0.25)")
expression_2 = Expression(x=int, y=num, Expression="y/(x*1.5)")
end_2 = EndPoints(Curve=shatter)  # -> Start, End
vec2pt = Vector2Pt(PointA=pln, PointB=eval.Point, Unitize=False)  # -> Vector, Length
pshift = ShiftPaths(Data=shatter, Offset="-2")
ln = Line(StartPoint=pln, EndPoint=end.Start)
align = AlignPlane(Plane=pln, Direction=vec2pt.Vector)  # -> Plane, Angle
amp = Amplitude(Vector=vec2pt.Vector, Amplitude=expr("x/10", expression))
prot = RotatePlane(Plane=align.Plane, Angle=-1.570796327)
move = Move(Geometry=eval.Point, Motion=amp)  # -> Geometry, Transform
pl_origin = PlaneOrigin(Base=prot, Origin=move.Geometry)
merge = Merge(Data1=pshift)
unit = UnitVector(Vector=ln)
ln_2 = Line(StartPoint=pln, EndPoint=end_2.Start)

tag = TextTag3D(Location=pl_origin, Text=c_script.WD, Size=expression_2, Justification=5)
crv = Curve(ln_2)

crv_2 = Curve(merge)

# ---- group: Compass / North Direction
vec = Vector(unit)

# ----
txt = Text(c_script.WD)
compass_direction = ClusterOutput(txt)  # Compass Direction as String
